# Grasshopper definition 4DP SMP GHfile.gh (Grasshopper 1.0.8)
# plug-ins: MeshEdit Components, Pufferfish, LadybugGrasshopper

size_radius_mm = Slider(32, range=0..100)
segment = Slider(4, range=3..8)

# ---- group: filename
panel = Panel("""1
2
3
4""")
panel_2 = Panel("""a
b
c
d
e""")
# Read file from existing design
panel_3 = Panel("""delft
taipei""")
concatenate = Concatenate(FragmentA=graft(panel_3), FragmentA_2="_", FragmentB=panel)
concatenate_2 = Concatenate(FragmentA=graft(concatenate), FragmentA_2="_", FragmentB=panel_2)  # -> flatten(Result)
list_item = ListItem(List=concatenate_2, Index=Slider(19, range=0..40), Wrap=True)
panel_4 = Panel(list_item)

# ---- group: draw gaps / line1
rotate_angle = Slider(0, range=0..360)
if_edge_parameter = Slider(0.625, range=0..1)
length_mm = Slider(38, range=0..100)

# ---- group: draw gaps / line2
length_mm_2 = Slider(10, range=0..100)
rotate_angle_2 = Slider(0, range=0..360)
if_edge_parameter_2 = Slider(0.53, range=0..1)

# ----
read_geometry = BooleanToggle(True)
read_geometry_2 = Python3Script(folder="D:\TUD\Thesis\design\typologies", name=list_item, load=read_geometry)  # -> out, slider_values, surface_geom
# ---------- read_geometry_2: Python ----------
# -*- coding: utf-8 -*-
"""Import saved slider data tree and rebuild geometries safely from native JSON strings in Rhino 8."""
import os
import pickle
import Rhino
import Rhino.Geometry as rg
import Grasshopper
from Grasshopper.Kernel.Data import GH_Path
from Grasshopper import DataTree

def restore_tree(tree_info):
    """Restore the Python dictionary back to a real Grasshopper Data Tree."""
    if not tree_info:
        return DataTree[object]()
    if tree_info["type"] == "tree":
        new_tree = DataTree[object]()
        for path_str, branch_list in tree_info["data"].items():
            clean_path = path_str.replace("{", "").replace("}", "")
            path_indices = [int(x) for x in clean_path.split(";")]
            gh_path = GH_Path(*path_indices)
            new_tree.AddRange(branch_list, gh_path)
        return new_tree
    else:
        return list(tree_info["data"])

# Initialize outputs
slider_values = DataTree[object]()
surface_geom = []

if _load and _folder and _name:
    # Automatically construct the absolute file path
    file_path = os.path.join(_folder, _name + ".pdata")
    
    if os.path.exists(file_path):
        try:
            with open(file_path, 'rb') as f:
                loaded_data = pickle.load(f)
            
            # 1. Restore Slider Data Tree
            if "sliders" in loaded_data:
                slider_values = restore_tree(loaded_data["sliders"])
            
            # 2. Rebuild Geometries from Native JSON Strings
            geo_json_list = loaded_data.get("surface_json_list", [])
            
            for g_json in geo_json_list:
                if g_json:
                    try:

                        restored_obj = rg.Runtime.CommonObject.FromJSON(g_json)
                        if restored_obj: 
                            surface_geom.append(restored_obj)
                    except:

                        try:
                            restored_obj = rg.GeometryBase.FromJSON(g_json)
                            if restored_obj:
                                surface_geom.append(restored_obj)
                        except Exception as geo_err:
                            print("⚠️ JSON restoration warning: {}".format(geo_err))
            
            print("🚀 SUCCESS: Data Tree and {} Geometries fully restored from JSON archive!".format(len(surface_geom)))
        except Exception as e:
            print("❌ Error reading file: {}".format(e))
    else:
        print("❌ File path does not exist: {}".format(file_path))
else:
    print("⏳ Please ensure _folder and _name are provided, then set _load to True.")
# ---------- end read_geometry_2 ----------

# ---- group: read
read_daylight_rad = BooleanToggle(False)
read_cfd = BooleanToggle(False)

# ----
# Controller
weather_data = BooleanToggle(False)

# ---- group: run
run_daylight = BooleanToggle(False)
run_glare = BooleanToggle(False)
run_rad = BooleanToggle(False)
run_cfd = BooleanToggle(False)

# ---- group: outlet
srf = Surface(<surface referenced from the Rhino model>)

# ---- group: inlet!
srf_2 = Surface(<surface referenced from the Rhino model>)

# ---- group: walls
brep = Brep([<brep referenced from the Rhino model> x6])

# ----
decomposepardict_scotch = Butterfly_decomposeParDictScotch(num_of_cpus="4")  # -> decompose_par_dict; plug-in component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

move_y = Slider(3.2, range=0..4)
move_z = Slider(1.2, range=0..3.5)

# ---- group: update inlet wind velocity
panel_5 = Panel("""boundaryField
{


west_window
    {

  
value		uniform (2.5 0.0 0.0);


}
}""")
panel_6 = Panel("U")

# ----
unit_y = UnitY(Factor=move_y)
unit_z = UnitZ(Factor=move_z)
brep_2 = Brep(<brep referenced from the Rhino model>)
brep_3 = Brep(<brep referenced from the Rhino model>)
srf_3 = Surface(<surface referenced from the Rhino model>)
move = Move(Geometry=brep_2, Motion=unit_y)  # -> Geometry, Transform
move_2 = Move(Geometry=brep_3, Motion=unit_z)  # -> Geometry, Transform
gentestpts = Honeybee_GenerateTestPoints(
    testGeometry=[move.Geometry, move_2.Geometry, srf_3],
    gridSize=Slider(0.3, range=0..1),
    distBaseSrf="0.05",
    moveTestMesh=Toggle(False))  # -> readMe, simplify(testPoints), simplify(ptsVectors), simplify(facesArea), simplify(mesh); plug-in component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
flatten = FlattenTree(Tree=gentestpts.testPoints, Path="{0}")
flatten_2 = FlattenTree(Tree=gentestpts.mesh, Path="{0}")
panel_7 = Panel("""p
U""")
controldict = Butterfly_controlDict(start_time=0, end_time="5000", write_interval=100, write_compression=False, purge_write=0)  # -> control_dict; plug-in component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
probes = Butterfly_probes(points=flatten, fields=panel_7)  # -> probes; plug-in component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

brep_wireframe = BrepWireframe(Brep=move.Geometry, Density=-1)
brep_wireframe_2 = BrepWireframe(Brep=move_2.Geometry, Density=-1)

# ----
# Slice Model
layer_height_mm = Slider(0.8, range=0..1)
thickness_radius = Slider(0.2, range=0..1)

# ---- group: read
read_saved_data = Python3Script(folder="C:\Users\ellen\butterfly\extracted\", name=list_item, load=read_cfd)  # -> out, meshes, points, flatten(p_values), u_values
# ---------- read_saved_data: Python ----------
# -*- coding: utf-8 -*-
"""Import Points, Meshes, P (Pressure) and U (Velocity) Values with Advanced Error Handling."""
import os
import pickle
import Rhino
import Rhino.Geometry as rg
import Grasshopper
from Grasshopper.Kernel.Data import GH_Path
from Grasshopper import DataTree

def deserialize_item(item):
    """Reconstruct packed pure data, specifically handling Vector3d dictionaries."""
    if isinstance(item, dict) and item.get("__type__") == "Vector3d":
        coords = item["data"]
        return rg.Vector3d(coords[0], coords[1], coords[2])
    return item

def restore_value_output(v_info):
    """Restore the pickled data back to Grasshopper Data Tree or List with robust error handling."""
    if v_info is None or "data" not in v_info:
        return DataTree[object]()
        
    if v_info.get("type") == "tree":
        new_tree = DataTree[object]()
        for path_str, branch_list in v_info["data"].items():
            # Convert path string like "{0;0}" back to GH_Path
            clean_path = path_str.replace("{", "").replace("}", "")
            # Handle potential empty or abnormal paths
            if not clean_path: 
                gh_path = GH_Path(0)
            else:
                path_indices = [int(x) for x in clean_path.split(";")]
                gh_path = GH_Path(*path_indices)
            
            # Ensure branch_list is iterable
            if branch_list is not None:
                restored_branch = [deserialize_item(x) for x in branch_list]
                new_tree.AddRange(restored_branch, gh_path)
        return new_tree
    else:
        if v_info.get("data") is not None:
            return [deserialize_item(x) for x in v_info["data"]]
        return []

# Initialize outputs to prevent errors when nothing is loaded
meshes = []
points = []
p_values = DataTree[object]()
u_values = DataTree[object]()

if _load and _folder and _name:
    # Automatically construct the absolute file path with .gdata extension
    file_path = os.path.join(_folder, _name + ".gdata")
    
    if os.path.exists(file_path):
        try:
            with open(file_path, 'rb') as f:
                loaded_data = pickle.load(f)
            
            # --- 1. Restore Meshes ---
            try:
                dir_name = os.path.dirname(file_path)
                if "meshes" in loaded_data and loaded_data["meshes"]:
                    for i, m_bytes in enumerate(loaded_data["meshes"]):
                        # Create a temporary .3dm file location for reconstruction
                        tmp_load_path = os.path.join(dir_name, "tmp_load_{}.3dm".format(i))
                        with open(tmp_load_path, 'wb') as tmp_f:
                            tmp_f.write(m_bytes)
                        
                        f3dm = Rhino.FileIO.File3dm.Read(tmp_load_path)
                        if f3dm and f3dm.Objects.Count > 0:
                            geom = f3dm.Objects[0].Geometry
                            if isinstance(geom, rg.Mesh):
                                meshes.append(geom)
                        
                        # Instantly clean up the temporary file from the hard drive
                        if os.path.exists(tmp_load_path):
                            os.remove(tmp_load_path)
            except Exception as mesh_err:
                print("⚠️ Notice: Mesh geometry restoration skipped. Reason: {}".format(mesh_err))
            
            # --- 2. Restore Points ---
            try:
                if "points" in loaded_data and loaded_data["points"]:
                    for pt_coords in loaded_data["points"]:
                        pt = rg.Point3d(pt_coords[0], pt_coords[1], pt_coords[2])
                        points.append(pt)
            except Exception as pt_err:
                print("⚠️ Notice: Points restoration skipped. Reason: {}".format(pt_err))
            
            # --- 3. Restore P (Pressure) Values ---
            try:
                if "p_values" in loaded_data and loaded_data["p_values"] is not None:
                    p_values = restore_value_output(loaded_data["p_values"])
            except Exception as p_err:
                print("⚠️ Notice: P (Pressure) data restoration failed. Reason: {}".format(p_err))
            
            # --- 4. Restore U (Velocity) Values ---
            try:
                if "u_values" in loaded_data and loaded_data["u_values"] is not None:
                    u_values = restore_value_output(loaded_data["u_values"])
            except Exception as u_err:
                print("⚠️ Notice: U (Velocity) data restoration failed. Reason: {}".format(u_err))
            
            print("🚀 Success: Restored {} meshes and {} points from file.".format(len(meshes), len(points)))
            
        except Exception as e:
            print("❌ Error: Core file reading failed: {}".format(e))
    else:
        print("❌ Error: File path does not exist: {}".format(file_path))
else:
    print("⏳ Waiting for input... Please ensure _folder and _name are filled, then set _load to True.")
# ---------- end read_saved_data ----------

# ---- group: curvature radius
gene_pool = GenePool(Decimals=0, Maximum=200, Minimum=1, Value=[43, 42, 39, 149])

# ----
# Read File Results
list_length = ListLength(List=gentestpts.testPoints)  # -> flatten(Length)

# ---- group: vectors
vec = Vector(read_saved_data.u_values)

# ---- group: points
pt = Point(flatten)

# ----
panel_8 = Panel("{1}")
panel_9 = Panel("""{0}
{1}
{2}""")
panel_10 = Panel("{0}")

# ---- group: create angle list for each layer / infill pattern
gene_pool_2 = GenePool(Decimals=0, Maximum=90, Minimum=-90, Value=[27, -48, -45, -5])

# ---- group: Select plane
partition_list = PartitionList(List=pt, Size=list_length)  # -> simplify(Chunks)
partition_list_2 = PartitionList(List=vec, Size=list_length)  # -> simplify(Chunks)
text = Text(panel_9)
mesh = Mesh(gentestpts.mesh)
tree_branch = TreeBranch(Tree=mesh, Path=text, MaintainPaths=True)
tree_branch_2 = TreeBranch(Tree=partition_list_2, Path=text, MaintainPaths=True)
tree_branch_3 = TreeBranch(Tree=partition_list, Path=text, MaintainPaths=True)

# ---- group: Anchor Location
gene_pool_3 = GenePool(Decimals=2, Maximum=0.5, Minimum=-0.5, Value=[-0.34, -0.26, -0.23, 0.243718593])

# ---- group: infill ratio
gene_pool_4 = GenePool(Decimals=1, Maximum=1, Minimum=0, Value=[0.3, 0.1, 0.6722222222, 0.4722222222])

# ---- group: ACH and Airflow Calculation
vlen = VectorLength(Vector=tree_branch_2)
construct_domain = ConstructDomain(DomainStart="91", DomainEnd="259")
sub_list = SubList(List=vlen, Domain=construct_domain, Wrap=True)  # -> List, Index
area = Area(Geometry=srf_3)  # -> Area, Centroid
python_3_script = Python3Script(vel=sub_list.List)  # -> out, clean_val; inputs vel: list of Double
# ---------- python_3_script: Python ----------
clean_val = []
for i in vel:
    if i > 50.0:
        clean_val.append(0)
    else:
        clean_val.append(i)
# ---------- end python_3_script ----------
python_3_script_2 = Python3Script(vel=vlen)  # -> out, clean_val; inputs vel: list of Double; same code as python_3_script
geo = Geometry(<extrusion referenced from the Rhino model>)
volume = Volume(Geometry=geo)  # -> Volume, Centroid
average = Average(Input=python_3_script_2.clean_val)
average_2 = Average(Input=python_3_script.clean_val)
multiplication = Multiplication(A=average, B=area.Area)
output_airflow = Number(average_2)
multiplication_2 = Multiplication(A=multiplication, B="3600")
division = Division(A=multiplication_2, B=volume.Volume)
ach = Number(division)
panel_11 = Panel(output_airflow)
panel_12 = Panel(ach)

# ----
# Weather Data
panel_13 = Panel("https://climate.onebuilding.org/WMO_Region_6_Europe/NLD_Netherlands/ZH_Zuid-Holland/NLD_ZH_Rotterdam.The.Hague.AP.063440_TMYx.zip")
panel_14 = Panel("https://climate.onebuilding.org/WMO_Region_2_Asia/TWN_Taiwan/NOR_Northern_Region/TWN_NOR_Taipei.589680_TMYx.zip")
stream_filter = StreamFilter(Gate=weather_data, Stream0=panel_13, Stream1=panel_14)
downloadepw = LBDownloadWeather(weather_URL=stream_filter)  # -> epw_file, stat_file, ddy_file; plug-in component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
wea = HBWeaFromEPW(epw_file=downloadepw.epw_file)  # -> wea; plug-in component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

# ---- group: Opaque
geo_2 = Geometry(<extrusion referenced from the Rhino model>)
roomsolid = HBRoomFromSolid(geo=flatten(geo_2), conditioned=True)  # -> out, rooms; plug-in component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

# ---- group: cell size
deconstruct_box = DeconstructBox(Box=geo_2)  # -> Plane, X, Y, Z
deconstruct_domain = DeconstructDomain(Domain=deconstruct_box.Y)  # -> Start, End
deconstruct_domain_2 = DeconstructDomain(Domain=deconstruct_box.X)  # -> Start, End
deconstruct_domain_3 = DeconstructDomain(Domain=deconstruct_box.Z)  # -> Start, End
size_per_pannel_m = Slider(0.7, range=0..1)
point = Point(<point referenced from the Rhino model>)
division_2 = Division(A=deconstruct_domain_3.End, B=size_per_pannel_m)
division_3 = Division(A=deconstruct_domain.End, B=size_per_pannel_m)
yz_plane = YZPlane(Origin=point)
round = Round(Number=division_2)  # -> Nearest, Floor, Ceiling
round_2 = Round(Number=division_3)  # -> Nearest, Floor, Ceiling
rectangular = Rectangular(Plane=yz_plane, SizeX=size_per_pannel_m, SizeY=size_per_pannel_m, ExtentX=round_2.Ceiling, ExtentY=round.Ceiling)  # -> Cells, Points
area_2 = Area(Geometry=rectangular.Cells)  # -> Area, Centroid
yz_plane_2 = YZPlane(Origin=area_2.Centroid)

# ----
xy_plane = XYPlane(Origin=Point(0, 0, 0))
polygon = Polygon(Plane=xy_plane, Radius=size_radius_mm, Segments=segment, FilletRadius=0)  # -> Polygon, Length
rectangle = Rectangle(Plane=PlaneXY(0, 0, 0), XSize=size_per_pannel_m, YSize=size_per_pannel_m, Radius=0)  # -> Rectangle, Length

md_slider = MDSlider(
    SliderMode=0,
    slider_value=Point(0.3116748951, 0.1045477731, 0.5),
    x_domain=Domain(0, 1),
    y_domain=Domain(0, 1),
    z_domain=Domain(0, 1))
evaluate_surface = EvaluateSurface(Surface=reparameterize(rectangle.Rectangle), Point=md_slider)  # -> Point, Normal, UDirection, VDirection, Frame

# ---- group: center xy plane
area_3 = Area(Geometry=rectangle.Rectangle)  # -> Area, Centroid
xy_plane_2 = XYPlane(Origin=area_3.Centroid)

# ---- group: Aperture
# Geometry Preparation
panel_15 = Panel("g_material")
glassmod = HBGlassModifier(name=panel_15, trans="0.55")  # -> modifier; plug-in component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
brep_4 = Brep(<brep referenced from the Rhino model>)
aperture = HBAperture(geo=brep_4, rad_mod=glassmod)  # -> report, apertures; plug-in component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
addsubface = HBAddSubface(hb_obj=flatten(roomsolid.rooms), sub_faces=flatten(aperture.apertures))  # -> hb_obj; plug-in component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
bordershades = HBExtrudedBorderShades(hb_objs=flatten(addsubface), depth="0.3")  # -> report, hb_objs; plug-in component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

# ----
# Daylight
panel_16 = Panel("smp")
transmod = HBTranslucentModifier(name=panel_16, diff_ref="0.4", diff_trans="0.3", spec="0.02")  # -> modifier; plug-in component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

# ---- group: Region Growing Segmentation / input a defined target surface
brep_5 = Brep(flatten([<brep referenced from the Rhino model> x3]))

# ----
brep_join = BrepJoin(Breps=brep_5)  # -> Breps, Closed

# ---- group: save and start
boolean_toggle = BooleanToggle(False)
panel_17 = Panel("D:\TUD\Thesis\design\gcode")

# ----
# Daylight
unit_x = UnitX(Factor=1)  # -> expr("-x", UnitVector)

# ----
# Sky
number_slider = Slider(12, range=1..12)
number_slider_2 = Slider(21, range=1..31)
number_slider_3 = Slider(11, range=0..23)
importloc = LBImportLocation(epw_file=downloadepw.epw_file)  # -> location; plug-in component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
ciesky = HBCIEStandardSky(north=unit_x, location=importloc, month=number_slider, day=number_slider_2, hour=number_slider_3, type=0)  # -> sky; plug-in component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

# ---- group: result
read_result = Python3Script(folder_name=list_item, load=read_daylight_rad)  # -> out, glare_hdr, annual_dir, sda_values, avg_irr_values, rad_values
# ---------- read_result: Python ----------
# -*- coding: utf-8 -*-
"""Map simulation directories and parse raw data from the 'da' subfolder while ignoring JSON metadata."""
import os

# Initialize outputs to prevent Grasshopper runtime errors
glare_hdr = None
annual_dir = None
avg_irr_values = []
rad_values = []
sda_values = []      # Directly outputs parsed sDA values (%) for each sensor point

# Hardcoded user profile name
user = "ellen"

def read_res_file(file_path):
    """Helper function to parse a Honeybee .res file and convert lines to float values."""
    values = []
    if os.path.exists(file_path):
        try:
            with open(file_path, 'r') as f:
                for line in f:
                    line = line.strip()
                    if line:
                        parts = [float(x) for x in line.split()]
                        if len(parts) == 1:
                            values.append(parts[0])
                        elif len(parts) > 1:
                            values.append(parts)
            return values
        except Exception as e:
            print("❌ Error reading file {}: {}".format(file_path, e))
            return []
    return []

def calculate_sda_from_da_folder(annual_enhanced_base_path):
    """Targets the 'da' folder directly under metrics and parses the true numerical matrix file."""
    da_dir = os.path.join(annual_enhanced_base_path, "metrics", "da")
    da_values = []
    
    if os.path.exists(da_dir):
        # Scan files inside the 'da' directory, explicitly FILTERING OUT .json files
        files = [f for f in os.listdir(da_dir) if os.path.isfile(os.path.join(da_dir, f)) and not f.lower().endswith('.json')]
        
        if files:
            # Target the first actual data file found (skipping json metadata)
            target_file = os.path.join(da_dir, files[0])
            try:
                with open(target_file, 'r') as f:
                    for line in f:
                        line = line.strip()
                        if line:
                            val = float(line.split()[0])
                            # Standardize to 0-100% format if saved as decimals (0.0 - 1.0)
                            if val <= 1.0 and val > 0:
                                val = val * 100.0
                            da_values.append(val)
                print("✅ Success: parsed active matrix file: {}".format(files[0]))
                return da_values
            except Exception as e:
                print("❌ Found DA file at {} but failed to parse: {}".format(files[0], e))
        else:
            print("⚠️ Notice: The 'da' folder exists, but contains no numerical matrix files (only JSONs or empty).")
    else:
        print("⚠️ Notice: Explicit 'da' folder not found at: {}".format(da_dir))
    return []

if _load:
    if _folder_name:
        # 1. Define the base simulation directory path for Honeybee
        base_path = os.path.join("C:\\Users", user, "simulation", _folder_name)
        
        # 2. Construct absolute paths for point-in-time glare and annual daylight
        hdr_target = os.path.join(base_path, "point_in_time_view", "results", "indoor_view.HDR")
        
        # This points to the main annual daylight enhanced folder
        annual_enhanced_base = os.path.join(base_path, "annual_daylight_enhanced")
        annual_target = os.path.join(annual_enhanced_base, "results")
        
        # File existence safety check for Glare HDR
        if os.path.exists(hdr_target):
            glare_hdr = hdr_target
            print("✅ Success: Glare HDR mapped successfully.")
        else:
            glare_hdr = hdr_target
            
        # File existence safety check for Annual Daylight directory
        if os.path.exists(annual_target):
            annual_dir = annual_target
            print("✅ Success: Annual Daylight directory retained and mapped.")
            
            # Extract sDA values using the JSON-filtered path parser
            sda_values = calculate_sda_from_da_folder(annual_enhanced_base)
            if sda_values:
                print("✅ Success: Directly extracted {} sDA values!".format(len(sda_values)))
        else:
            annual_dir = annual_target
            
        # 3. Pinpoint the explicit .res file paths for Radiation and Irradiance
        rad_base_target = os.path.join(base_path, "cumulative_radiation", "results")
        
        irr_file = os.path.join(rad_base_target, "average_irradiance", "Room_1_ExteriorApertures.res")
        rad_file = os.path.join(rad_base_target, "cumulative_radiation", "Room_1_ExteriorApertures.res")
        
        # 4. Read and extract raw values directly from the .res files
        if os.path.exists(irr_file):
            avg_irr_values = read_res_file(irr_file)
            print("✅ Success: Directly extracted {} values from IRR .res file!".format(len(avg_irr_values)))
        else:
            print("⚠️ Notice: IRR .res file not found at the expected path.")
            
        if os.path.exists(rad_file):
            rad_values = read_res_file(rad_file)
            print("✅ Success: Directly extracted {} values from RAD .res file!".format(len(rad_values)))
        else:
            print("⚠️ Notice: RAD .res file not found at the expected path.")
            
    else:
        print("⏳ Waiting for project folder name... Please provide '_folder_name'.")
else:
    print("⏳ Component on standby. Set '_load' to True to map simulation results.")
# ---------- end read_result ----------

# ---- group: filename
panel_18 = Panel("""1
2
3
4""")
panel_19 = Panel("""a
b
c
d
e""")
panel_20 = Panel("""delft
taipei""")
concatenate_3 = Concatenate(FragmentA=graft(panel_20), FragmentA_2="_", FragmentB=panel_18)
concatenate_4 = Concatenate(FragmentA=graft(concatenate_3), FragmentA_2="_", FragmentB=panel_19)  # -> flatten(Result)
list_item_2 = ListItem(List=concatenate_4, Index=Slider(17, range=0..23), Wrap=True)
panel_21 = Panel(list_item_2)

# ----
legendpar = LBLegendParameters(num_decimals="0")  # -> leg_par; plug-in component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

# ---- group: extrude thickness / thickness
gene_pool_5 = GenePool(Decimals=1, Maximum=2, Minimum=1, Value=[1.5, 1.5, 1.5, 1.5])

# ----
# Unit Geometry Design
number_slider_4 = Slider(45, range=0..100)
rotate = Rotate(Geometry=polygon.Polygon, Angle=degrees(number_slider_4), Plane=PlaneXY(0, 0, 0))  # -> Geometry, Transform

# ---- group: along the curve cut / bounding rotate circle
project = Project(Geometry=rectangle.Rectangle, Plane=PlaneXY(0, 0, 0))  # -> Geometry, Transform

# ---- group: draw gaps
one_line_false_or_two_line_true = BooleanToggle(False)
center_false_or_edges_true = BooleanToggle(False)
unit_y_2 = UnitY(Factor=1)

merge = Merge(Data1=length_mm, Data2=length_mm_2)  # -> simplify(graft(Result))
stream_filter_2 = StreamFilter(Gate=one_line_false_or_two_line_true, Stream0=length_mm, Stream1=merge)

# ---- group: draw gaps / set ref point
merge_2 = Merge(Data1=if_edge_parameter, Data2=if_edge_parameter_2)  # -> simplify(graft(Result))
area_4 = Area(Geometry=rectangle.Rectangle)  # -> Area, Centroid
stream_filter_3 = StreamFilter(Gate=one_line_false_or_two_line_true, Stream0=if_edge_parameter, Stream1=merge_2)
evaluate_curve = EvaluateCurve(Curve=reparameterize(rectangle.Rectangle), Parameter=stream_filter_3)  # -> Point, Tangent, Angle
stream_filter_4 = StreamFilter(Gate=center_false_or_edges_true, Stream0=area_4.Centroid, Stream1=evaluate_curve.Point)

# ---- group: draw gaps
merge_3 = Merge(Data1=rotate_angle, Data2=rotate_angle_2)  # -> simplify(graft(Result))
stream_filter_5 = StreamFilter(Gate=one_line_false_or_two_line_true, Stream0=rotate_angle, Stream1=merge_3)

# ---- group: along the curve cut
bounding_box = BoundingBox(Content=project.Geometry, Plane=PlaneXY(0, 0, 0))  # -> Box, Box_2
unit_y_3 = UnitY(Factor=1)
xy_plane_3 = XYPlane(Origin=stream_filter_4)

# ---- group: along the curve cut / bounding rotate circle (continued)
deconstruct_brep = DeconstructBrep(Brep=bounding_box.Box)  # -> Faces, Edges, Vertices
circle_fit = CircleFit(Points=deconstruct_brep.Vertices)  # -> Circle, Radius, Deviation

# ---- group: draw gaps (continued)
line_sdl = LineSDL(Start="0,0,0", Direction=unit_y_2, Length=stream_filter_2)
xy_plane_4 = XYPlane(Origin=stream_filter_4)

curve_middle = CurveMiddle(Curve=line_sdl)
end_points = EndPoints(Curve=line_sdl)  # -> Start, End
stream_filter_6 = StreamFilter(Gate=center_false_or_edges_true, Stream0=curve_middle, Stream1=end_points.Start)

orient = Orient(Geometry=line_sdl, Source=stream_filter_6, Target=stream_filter_4)  # -> Geometry, Transform
rotate_2 = Rotate(Geometry=orient.Geometry, Angle=degrees(stream_filter_5), Plane=xy_plane_4)  # -> Geometry, Transform

# ---- group: gap offset
panel_22 = Panel("""-0.5
0.5""")
offset_curve = OffsetCurve(Curve=rotate_2.Geometry, Distance=panel_22, Corners=1)
trim_tree = TrimTree(Tree=offset_curve, Depth=1)
dispatch = Dispatch(List=trim_tree, DispatchPattern=[True, False])  # -> ListA, ListB
flip_curve = FlipCurve(Curve=dispatch.ListA)  # -> Curve, Flag
weave = Weave(Pattern=[0, 1], Stream0=flip_curve.Curve, Stream1=dispatch.ListB, NullGaps=False)
connect_curves = ConnectCurves(Curves=weave, Continuity="0", Close=True, Bulge=1)

# ----
boundary_surfaces = BoundarySurfaces(Edges=connect_curves)

# ---- group: along the curve cut (continued)
line_sdl_2 = LineSDL(Start="0,0,0", Direction=unit_y_3, Length=expr("2*x", circle_fit.Radius))

curve_middle_2 = CurveMiddle(Curve=line_sdl_2)
end_points_2 = EndPoints(Curve=line_sdl_2)  # -> Start, End
stream_filter_7 = StreamFilter(Gate=center_false_or_edges_true, Stream0=curve_middle_2, Stream1=end_points_2.Start)

orient_2 = Orient(Geometry=line_sdl_2, Source=stream_filter_7, Target=stream_filter_4)  # -> Geometry, Transform
rotate_3 = Rotate(Geometry=orient_2.Geometry, Angle=degrees(stream_filter_5), Plane=xy_plane_3)  # -> simplify(Geometry), Transform

# ---- group: 90 degrees cut
end_points_3 = EndPoints(Curve=rotate_2.Geometry)  # -> Start, End
orient_3 = Orient(Geometry=line_sdl_2, Source=curve_middle_2, Target=end_points_3.End)  # -> Geometry, Transform
xy_plane_5 = XYPlane(Origin=end_points_3.End)
rotate_4 = Rotate(Geometry=orient_3.Geometry, Angle=expr("x+90", degrees(stream_filter_5)), Plane=xy_plane_5)  # -> simplify(Geometry), Transform

# ----
merge_4 = Merge(Data1=rotate_4.Geometry, Data2=rotate_2.Geometry)

cut_90 = BooleanToggle(False)
cut = BooleanToggle(True)
fragment_stream = Python3Script(
    gap=one_line_false_or_two_line_true,
    edge=center_false_or_edges_true,
    cut_a_edge=cut,
    cut_a=rotate_3.Geometry,
    edge_cut_90=cut_90,
    cut_90=merge_4)  # -> out, frag
# ---------- fragment_stream: Python ----------
# only one gap
if gap is False:
    # located in center
    if edge is False:
        # cut the polygon
        if cut_a_edge is True:
            frag = cut_a
        # dont cut
        else:
            frag is None
    # located in edge
    else:
        if edge_cut_90 is True:
            frag = cut_90
        else:
            #cut_a == cut_0
            frag = cut_a
# two gaps
else:
    frag = cut_a
# ---------- end fragment_stream ----------
boundary_surfaces_2 = BoundarySurfaces(Edges=rectangle.Rectangle)
curve = Curve(fragment_stream.frag)
surface_split = SurfaceSplit(Surface=boundary_surfaces_2, Curves=flatten(fragment_stream.frag))  # -> simplify(graft(Fragments))

# ---- group: extrude thickness
thickness = Slider(3.3, range=0..10)
unit_z_2 = UnitZ(Factor=thickness)
extrude = Extrude(Base=surface_split, Direction=unit_z_2)

# ---- group: slice layer
contour = Contour(Shape=extrude, Point=Point(0, 0, 0), Direction=Vector(0, 0, 1), Distance=layer_height_mm)

# ---- group: outwall
offset_curve_2 = OffsetCurve(Curve=contour, Distance=expr("-x*0.001", thickness_radius), Corners=1)  # -> simplify(Curve)

# ---- group: create angle list for each layer
list_length_2 = ListLength(List=flatten(extrude))
construct_domain_2 = ConstructDomain(DomainStart=0, DomainEnd=expr("x-1", list_length_2))
trim_tree_2 = TrimTree(Tree=contour, Depth=1)
sub_list_2 = SubList(List=gene_pool_2, Domain=construct_domain_2, Wrap=True)  # -> List, Index
list_length_3 = ListLength(List=trim_tree_2)
panel_23 = Panel(sub_list_2.List)
duplicate_data = DuplicateData(Data=graft(sub_list_2.List), Number=list_length_3, Order=list_length_3)
addition = Addition(A=graft(sub_list_2.List), B="90")
replace_items = ReplaceItems(List=duplicate_data, Item=addition, Indices="1", Wrap=False)  # -> simplify(graft(List))
panel_24 = Panel(replace_items)

# ----
list_length_4 = ListLength(List=flatten(extrude))
construct_domain_3 = ConstructDomain(DomainStart=0, DomainEnd=expr("x-1", list_length_4))
sub_list_3 = SubList(List=gene_pool_3, Domain=construct_domain_3, Wrap=True)  # -> graft(List), Index

# ----
# create butterfly surface
panel_25 = Panel("-1.2")
vec_2 = VectorXYZ(XComponent=panel_25, YComponent=0, ZComponent=0)  # -> Vector, Length
wall = Butterfly_WallBoundary()  # -> wall_boundary; plug-in component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
outlet = Butterfly_OutletBoundary()  # -> outlet_boundary; plug-in component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
inletvel = Butterfly_InletBoundary(velocity_vec=vec_2.Vector)  # -> inlet_boundary; plug-in component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
brep_6 = Brep([<brep referenced from the Rhino model> x4])
srf_4 = Surface(<surface referenced from the Rhino model>)
brep_7 = Brep(<brep referenced from the Rhino model>)
area_5 = Area(Geometry=srf_2)  # -> Area, Centroid
number_slider_5 = Slider(0.01, range=0..0.1)
wires = BrepWireframe(Brep=brep, Density=-1)
preview = CustomPreview(Geometry=srf_2, Shader=ColourSwatch(SwatchColor=RGBA(48, 145, 255, 77)))
wires_2 = BrepWireframe(Brep=[brep_7, brep_6], Density=-1)
preview_2 = CustomPreview(Geometry=[srf, srf_4], Shader=ColourSwatch(SwatchColor=RGBA(255, 0, 255, 77)))
vdis = VectorDisplay(Anchor=area_5.Centroid, Vector=vec_2.Vector)

# ---- group: input geometry
number_slider_6 = Slider(0.001, range=0..0.001)

# ---- group: tilt angle
rotate_angle_3 = Slider(-45, range=-180..180)

# ----
jagged = SettingsSpeed()
createbfgeometry = Butterfly_CreateButterflyGeometry(name="Surroundings", geo=flatten(brep_7), boundary=wall, refine_levels="(2,2)", mesh_set=jagged)  # -> report, BF_geo; plug-in component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
createbfgeometry_2 = Butterfly_CreateButterflyGeometry(name="window", geo=flatten(srf_2), boundary=inletvel, refine_levels="(2,2)", mesh_set=jagged)  # -> report, BF_geo; plug-in component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
createbfgeometry_3 = Butterfly_CreateButterflyGeometry(name="room", geo=flatten(brep), boundary=wall, mesh_set=jagged)  # -> report, BF_geo; plug-in component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
createbfgeometry_4 = Butterfly_CreateButterflyGeometry(name="door", geo=flatten([srf, srf_4]), boundary=outlet, refine_levels="(2,2)", mesh_set=jagged)  # -> report, BF_geo; plug-in component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
createbfgeometry_5 = Butterfly_CreateButterflyGeometry(name="wind_boundaries", geo=flatten(brep_6), boundary=wall, refine_levels="(2,2)", mesh_set=jagged)  # -> report, BF_geo; plug-in component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

larger_than_90_to_get_the_hard_edges = Panel("castellatedMeshControls  {resolveFeatureAngle 95;}")

# ----
# CFD
# SOLUTION
toggle = BooleanToggle(False)
solutionparam = Butterfly_SolutionParameter(filename=panel_6, values=panel_5, replace=False)  # -> solution_par; plug-in component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
solutionparams = Butterfly_SolutionParameters(control_dict=controldict, probes=probes)  # -> solution_par; plug-in component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
steadyincomp = Butterfly_SteadyIncompressibleRecipe()  # -> report, recipe; plug-in component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

snappyhexmeshdict = Butterfly_snappyHexMeshDict(
    castellated_mesh=True,
    snap=Toggle(True),
    add_layers=False,
    n_cells_btwn_levels=3,
    max_global_cells=2000000,
    srf_feature_level="3",
    expansion_ratio=1.1,
    final_layer_thickness=0.7,
    min_thickness=0.1,
    n_layer_iter=50,
    additional_par=larger_than_90_to_get_the_hard_edges)  # -> snappy_hex_mesh_dict; plug-in component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

# ---- group: delft_2_d rotate
panel_26 = Panel("""90
0
90
0
90""")
panel_27 = Panel("""180
-90
180
-90
180""")
duplicate_data_2 = DuplicateData(Data=[panel_26, panel_27], Number=Slider(3, range=0..10), Order=True)
number = Number(duplicate_data_2)

# ----
# purge case
toggle_2 = BooleanToggle(False)

# ----
# BLOCKMESH
toggle_3 = BooleanToggle(True)

# ---- group: mesh
settings_custom = SettingsCustom(
    StitchSeams=Toggle(True),
    SimplePlanes=Toggle(True),
    Refine=Toggle(False),
    MinCount=16,
    MaxCount="2000",
    AspectRatio=20,
    MaxDistance=0,
    MaxAngle=20,
    MinEdge="0.05",
    MaxEdge="0.2")

# ----
# SNAPPYHEXMESH
toggle_4 = BooleanToggle(True)

# ----
# VISUALIZE MESH
toggle_5 = BooleanToggle(False)

# ----
# PLOT RESIDUALS
number_slider_7 = Slider(391, range=0..1000)
construct_domain_4 = ConstructDomain(DomainStart=0, DomainEnd=number_slider_7)
rec = Rectangle({Plane=PlaneXY(1, -6, 0), Size=Domain2(u=0..15, v=0..5)})

# ---- group: center plane of rolling axis / perp plane
panel_28 = Panel("0.5")
unit_z_3 = UnitZ(Factor=1)

# ----
list_length_5 = ListLength(List=flatten(extrude))
construct_domain_5 = ConstructDomain(DomainStart=0, DomainEnd=expr("x-1", list_length_5))

# ----
# Deform Simulation
number_2 = Number(expr("x*0.01", gene_pool))

sub_list_4 = SubList(List=number_2, Domain=construct_domain_5, Wrap=True)  # -> graft(List), Index

# ---- group: data mapping
one_over_x = OneOverX(Value=sub_list_4.List)
inverse_design_lookup = Python3Script(target_k=simplify(one_over_x), material="SMP", k_type="mean")  # -> out, simplify(closest_specimen), simplify(estimated_thickness), simplify(estimated_infill)
# ---------- inverse_design_lookup: Python ----------
# -*- coding: utf-8 -*-
"""Reverse Lookup Engine: Reengineered to support extreme extrapolation down to 30% Infill with accelerated curvature decay."""
import math

# ==============================================================================
# 1. CENTRAL DATABASE (With mathematically derived non-linear 30%-50% extrapolation)
# ==============================================================================
# Structure: [Specimen ID, Thickness, Infill, k_max, k_mean]
EXTENDED_DATABASE = [
    # --- Thickness Testing Series (A-TPU) ---
    ["A-TPU-2*", 1.2, 70, 0.041, 0.014],
    ["A-TPU-3",  1.6, 70, 0.030, 0.017],
    ["A-TPU-4",  2.0, 70, 0.027, 0.010],
    
    # --- Reengineered Infill Testing Series (B-TPU) ---
    # Extreme push zone (30%-50%): Curvature explodes as infill drops
    ["B-TPU-EXTREME-30", 1.2, 30, 0.380, 0.095], # Extrapolated: structural collapse point
    ["B-TPU-EXTREME-40", 1.2, 40, 0.230, 0.058], # Extrapolated: rapid curvature transition
    ["B-TPU-EXTREME-50", 1.2, 50, 0.140, 0.035], # Extrapolated: onset of rapid decay
    
    # Standard Experimental baseline
    ["B-TPU-1",          1.2, 55, 0.110, 0.027],
    ["B-TPU-2*",         1.2, 70, 0.041, 0.014],
    ["B-TPU-3",          1.2, 85, 0.048, 0.012],
]

def lerp(x, x0, x1, y0, y1):
    """Linear interpolation formula."""
    if abs(x1 - x0) < 1e-6:
        return y0
    return y0 + (x - x0) * (y1 - y0) / (x1 - x0)

def constrain_thickness(raw_thick):
    """Apply strict engineering constraints: minimum 1.0mm, increment by 0.2mm."""
    if raw_thick is None:
        return None
    if raw_thick < 1.0:
        return 1.0
        
    base = 1.0
    step = 0.2
    steps_count = round((raw_thick - base) / step)
    constrained_val = base + (steps_count * step)
    return round(constrained_val, 1)

# ==============================================================================
# 2. CORE INTERPOLATION LOGIC
# ==============================================================================
closest_specimen = "N/A"
estimated_thickness = None
estimated_infill = None

if target_k is not None and material is not None:
    mat_input = str(material).upper().strip()
    
    if mat_input in ["TPU", "SMP", "SMP-TPU"]:
        type_str = str(k_type).lower().strip()
        k_idx = 4 if type_str == "mean" else 3
        
        # 2.1 Nearest-Neighbor baseline tracker
        min_diff = float('inf')
        best_row = None
        for row in EXTENDED_DATABASE:
            diff = abs(row[k_idx] - target_k)
            if diff < min_diff:
                min_diff = diff
                best_row = row
        if best_row:
            closest_specimen = best_row[0]

        # 2.2 Split into Thickness Series (A) and Infill Series (B)
        thick_series = [row for row in EXTENDED_DATABASE if "A-TPU" in row[0]]
        infill_series = [row for row in EXTENDED_DATABASE if "B-TPU" in row[0]]

        thick_series.sort(key=lambda x: x[k_idx])
        infill_series.sort(key=lambda x: x[k_idx])

        # --- Continuous Thickness Interpolation ---
        raw_thickness = None
        if target_k <= thick_series[0][k_idx]:
            raw_thickness = thick_series[0][1]
        elif target_k >= thick_series[-1][k_idx]:
            raw_thickness = thick_series[-1][1]
        else:
            for i in range(len(thick_series) - 1):
                k0 = thick_series[i][k_idx]
                k1 = thick_series[i+1][k_idx]
                if k0 <= target_k <= k1:
                    raw_thickness = lerp(target_k, k0, k1, thick_series[i][1], thick_series[i+1][1])
                    break

        # Apply strict 0.2mm step constraint
        estimated_thickness = constrain_thickness(raw_thickness)

        # --- Reengineered Infill Interpolation (Now with 30%-50% Supercharged Zone) ---
        # Note: B-Series is sorted by Curvature. 
        # Since lower Infill gives higher Curvature, the 30% row will be at the very END of the sorted list.
        if target_k <= infill_series[0][k_idx]:
            # Curvature is lower than standard 85% infill baseline
            estimated_infill = infill_series[0][2]
        elif target_k >= infill_series[-1][k_idx]:
            # Curvature is so high it exceeds our absolute 30% infill limit! Lock at 30%
            estimated_infill = infill_series[-1][2]
            print("⚠️ MAXIMUM CRITICAL PUSH: Target curvature exceeds normal limits. Structure must be slammed to 30% Infill!")
        else:
            for i in range(len(infill_series) - 1):
                k0 = infill_series[i][k_idx]
                k1 = infill_series[i+1][k_idx]
                if k0 <= target_k <= k1:
                    estimated_infill = lerp(target_k, k0, k1, infill_series[i][2], infill_series[i+1][2])
                    break
                    
        if estimated_infill is not None: estimated_infill = round(estimated_infill, 1)

        print("🎯 SYSTEM MODE: [ SMP-TPU EXTREME ACTIVE ]")
        print("📐 Output locked -> Thickness: {} mm | Infill: {} %".format(estimated_thickness, estimated_infill))
        if estimated_infill <= 50:
            print("🔥 DANGER ZONE: You are currently operating in the 30%-50% rapid-collapse curve. Expect high structural compliance!")
    else:
        print("⚠️ Material selection error. Please connect a Panel with 'TPU' or 'SMP'.")
else:
    print("⏳ Waiting for target curvature input (_target_k) and material string...")
# ---------- end inverse_design_lookup ----------
panel_29 = Panel(inverse_design_lookup.closest_specimen)
panel_30 = Panel(inverse_design_lookup.estimated_infill)
panel_31 = Panel(inverse_design_lookup.estimated_thickness)

# ----
panel_32 = Panel(sub_list_4.List)

# ---- group: bounding rotate circle
project_2 = Project(Geometry=offset_curve_2, Plane=PlaneXY(0, 0, 0))  # -> Geometry, Transform

# ----
# Create Printing Paths Array
bounding_box_2 = BoundingBox(Content=project_2.Geometry, Plane=PlaneXY(0, 0, 0))  # -> Box, Box_2

# ---- group: bounding rotate circle (continued)
deconstruct_brep_2 = DeconstructBrep(Brep=bounding_box_2.Box)  # -> Faces, Edges, Vertices
circle_fit_2 = CircleFit(Points=deconstruct_brep_2.Vertices)  # -> Circle, Radius, Deviation

# ---- group: create and rotate central line
panel_33 = Panel("""0,1,0
0,-1,0""")
line_sdl_3 = LineSDL(Start=circle_fit_2.Circle, Direction=panel_33, Length=circle_fit_2.Radius)
join_curves = JoinCurves(Curves=line_sdl_3, Preserve=False)
xy_plane_6 = XYPlane(Origin=circle_fit_2.Circle)
rotate_5 = Rotate(Geometry=join_curves, Angle=degrees(replace_items), Plane=xy_plane_6)  # -> simplify(Geometry), Transform

# ---- group: center plane of rolling axis
get_main_rolling_axis = Python3Script(x=rotate_5.Geometry)  # -> out, main_axis; inputs x: tree of Line
# ---------- get_main_rolling_axis: Python ----------
import clr
import Grasshopper
from Grasshopper.Kernel.Data import GH_Path

# Create a native Grasshopper DataTree to manually control the output paths
# Using Grasshopper.DataTree[object]() ensures compatibility across Python engines
output_tree = Grasshopper.DataTree[object]()
data_paths = x.Paths

# Case 1: Handle a flat list structure (e.g., {0}, {1}, {2}, {3}...)
if len(data_paths) > 0 and data_paths[0].Length == 1:
    for path in data_paths:
        if path[0] == 1:
            branch_data = list(x.Branch(path))
            # Output directly into a clean {1} branch
            output_tree.AddRange(branch_data, GH_Path(1))

# Case 2: Handle multi-branched tree structures (e.g., {0;0}, {0;1}...)
else:
    for path in data_paths:
        if path.Length >= 2:
            # Look specifically for the sub-index 1 ({0;1}, {1;1}, {2;1}...)
            if path[1] == 1:
                branch_data = list(x.Branch(path))
                
                # Extract the original main index (e.g., 0 from {0;1})
                main_index = path[0] 
                
                # Construct a brand new target path using only the main index {main_index}
                target_path = GH_Path(main_index)
                
                # Add the data directly into this specific branch
                output_tree.AddRange(branch_data, target_path)

# Assign the manually constructed DataTree to the output variable
main_axis = output_tree
# ---------- end get_main_rolling_axis ----------

# ---- group: center plane of rolling axis / perp plane (continued)
evaluate_curve_2 = EvaluateCurve(Curve=reparameterize(get_main_rolling_axis.main_axis), Parameter=panel_28)  # -> Point, Tangent, Angle
cross_product = CrossProduct(VectorA=evaluate_curve_2.Tangent, VectorB=unit_z_3, Unitize=False)  # -> expr("-x", Vector), Length
cross_product_2 = CrossProduct(VectorA=cross_product.Vector, VectorB=evaluate_curve_2.Tangent, Unitize=False)  # -> expr("-x", Vector), Length
construct_plane = ConstructPlane(Origin=evaluate_curve_2.Point, XAxis=cross_product.Vector, YAxis=cross_product_2.Vector)

# ---- group: center plane of rolling axis (continued)
vector_display = VectorDisplay(Anchor=evaluate_curve_2.Point, Vector=cross_product.Vector)
vector_display_2 = VectorDisplay(Anchor=evaluate_curve_2.Point, Vector=cross_product_2.Vector)

# ---- group: analyze fragments
bounding_box_3 = BoundingBox(Content=surface_split, Plane=simplify(graft(construct_plane)))  # -> Box, Box_2
deconstruct_box_2 = DeconstructBox(Box=bounding_box_3.Box)  # -> Plane, X, Y, Z
deconstruct_domain_4 = DeconstructDomain(Domain=deconstruct_box_2.X)  # -> Start, End
deconstruct_domain_5 = DeconstructDomain(Domain=deconstruct_box_2.Z)  # -> Start, End
subtraction = Subtraction(A=deconstruct_domain_4.End, B=deconstruct_domain_4.Start)
subtraction_2 = Subtraction(A=deconstruct_domain_5.End, B=deconstruct_domain_5.Start)
absolute = Absolute(Value=subtraction)
absolute_2 = Absolute(Value=subtraction_2)

# ---- group: hori plane
evaluate_curve_3 = EvaluateCurve(Curve=reparameterize(simplify(graft(get_main_rolling_axis.main_axis))), Parameter=panel_28)  # -> Point, Tangent, Angle
unit_z_4 = UnitZ(Factor=1)
cross_product_3 = CrossProduct(VectorA=evaluate_curve_3.Tangent, VectorB=unit_z_4, Unitize=False)  # -> expr("-x", Vector), Length
construct_plane_2 = ConstructPlane(Origin=evaluate_curve_3.Point, XAxis=evaluate_curve_3.Tangent, YAxis=cross_product_3.Vector)

# ---- group: anchor move along the axis
deconstruct_plane = DeconstructPlane(Plane=construct_plane)  # -> Origin, XAxis, YAxis, ZAxis
multiplication_3 = Multiplication(A=absolute, B=sub_list_3.List)
amplitude = Amplitude(Vector=expr("-X", deconstruct_plane.XAxis), Amplitude=multiplication_3)
unit_z_5 = UnitZ(Factor=sub_list_4.List)
addition_2 = Addition(A=amplitude, B=unit_z_5)

# ---- group: same bending length calculation
subtraction_3 = Subtraction(A=absolute, B=multiplication_3)
expression = Expression(L=absolute, R=sub_list_4.List, Expression="L / R")
expression_2 = Expression(L=subtraction_3, R=sub_list_4.List, Expression="L / R")
degrees = Degrees(Radians=expression_2)
degrees_2 = Degrees(Radians=expression)
division_4 = Division(A=degrees_2, B="2")
subtraction_4 = Subtraction(A=division_4, B=degrees)
addition_3 = Addition(A=degrees_2, B=subtraction_4)

# ---- group: move to center of the box
mesh_area = MeshArea(Mesh=bounding_box_3.Box)  # -> Area, Centroid
vector_2pt = Vector2Pt(PointA=simplify(graft(construct_plane)), PointB=simplify(mesh_area.Centroid), Unitize=False)  # -> Vector, Length
move_3 = Move(Geometry=construct_plane_2, Motion=vector_2pt.Vector)  # -> Geometry, Transform

# ---- group: move to center
move_to_center = Move(Geometry=simplify(graft(construct_plane)), Motion=vector_2pt.Vector)  # -> Geometry, Transform

# ----
radians = Radians(Degrees=expr("x-90", subtraction_4))
radians_2 = Radians(Degrees=expr("x-90", addition_3))
construct_domain_6 = ConstructDomain(DomainStart=radians, DomainEnd=radians_2)

move_4 = Move(Geometry=move_to_center.Geometry, Motion=addition_2)  # -> Geometry, Transform
arc = Arc(Plane=simplify(graft(move_4.Geometry)), Radius=sub_list_4.List, Angle=simplify(construct_domain_6))  # -> Arc, Length

# ---- group: move to bottom left
deconstruct_plane_2 = DeconstructPlane(Plane=move_3.Geometry)  # -> Origin, XAxis, YAxis, ZAxis
amplitude_2 = Amplitude(Vector=simplify(graft(deconstruct_plane_2.YAxis)), Amplitude=expr("-x/2", simplify(absolute)))
amplitude_3 = Amplitude(Vector=simplify(graft(deconstruct_plane_2.XAxis)), Amplitude=expr("-x/2", simplify(absolute_2)))
addition_4 = Addition(A=amplitude_3, B=amplitude_2)
move_5 = Move(Geometry=move_3.Geometry, Motion=addition_4)  # -> Geometry, Transform

# ---- group: move to edge of deformed geometry
amplitude_4 = Amplitude(Vector=expr("-x", simplify(graft(move_to_center.Geometry))), Amplitude=expr("x/2", simplify(absolute_2)))
move_6 = Move(Geometry=arc.Arc, Motion=simplify(amplitude_4))  # -> Geometry, Transform

# ----
amplitude_5 = Amplitude(Vector=simplify(graft(move_to_center.Geometry)), Amplitude=simplify(absolute_2))
extrude_2 = Extrude(Base=move_6.Geometry, Direction=simplify(amplitude_5))

deconstruct_brep_3 = DeconstructBrep(Brep=bounding_box_3.Box)  # -> Faces, Edges, Vertices
list_item_3 = ListItem(List=deconstruct_brep_3.Edges, Index=Slider(2, range=0..10), Wrap=True)
curve_2 = Curve(deconstruct_brep_3.Edges)
vector_display_3 = VectorDisplay(Anchor=evaluate_curve_3.Point, Vector=evaluate_curve_3.Tangent)
rectangle_2 = Rectangle(Plane=move_5.Geometry, XSize=absolute_2, YSize=absolute, Radius=0)  # -> Rectangle, Length
boundary_surfaces_3 = BoundarySurfaces(Edges=rectangle_2.Rectangle)
sporph = Sporph(
    Geometry=simplify(surface_split),
    Base=reparameterize(simplify(boundary_surfaces_3)),
    Target=reparameterize(simplify(extrude_2)),
    Rigid=False)  # -> simplify(Geometry)

# ---- group: input geometry (continued)
group = Group(Geometry=flatten(sporph))
scale_nu = ScaleNU(Geometry=group, Plane=PlaneXY(0, 0, 0), ScaleX=number_slider_6, ScaleY=number_slider_6, ScaleZ=number_slider_6)  # -> Geometry, Transform

# ---- group: delft_2_b flip
# This file is set up in meters. If you're using a different units make sure to scale the input geometries.
bounding_box_4 = BoundingBox(Content=scale_nu.Geometry, Plane=PlaneXY(0, 0, 0))  # -> Box, Box_2
volume_2 = Volume(Geometry=bounding_box_4.Box)  # -> Volume, Centroid
xy_plane_7 = XYPlane(Origin=volume_2.Centroid)
mirror = Mirror(Geometry=scale_nu.Geometry, Plane=xy_plane_7)  # -> Geometry, Transform

# ----
# Facade Design
geometry = Geometry(scale_nu.Geometry)

# ---- group: tilt angle (continued)
yz_plane_3 = YZPlane(Origin=volume_2.Centroid)
rotate_6 = Rotate(Geometry=scale_nu.Geometry, Angle=degrees(rotate_angle_3), Plane=yz_plane_3)  # -> Geometry, Transform

# ---- group: orient to facade
orient_4 = Orient(Geometry=group, Source=xy_plane_2, Target=yz_plane_2)  # -> Geometry, Transform

# ---- group: delft_2_d rotate (continued)
rotate_7 = Rotate(Geometry=flatten(orient_4.Geometry), Angle=degrees(number), Plane=flatten(yz_plane_2))  # -> Geometry, Transform

# ---- group: mesh (continued)
ungroup = Ungroup(Group=orient_4.Geometry)
mesh_brep = MeshBrep(Brep=ungroup, Settings=settings_custom)
triangulate = Triangulate(Mesh=mesh_brep)  # -> Mesh, Count

# ----
mesh_2 = Mesh(triangulate.Mesh)

createbfgeometry_6 = Butterfly_CreateButterflyGeometry(name="facade", geo=flatten(mesh_2), boundary=wall, refine_levels="(7,8)", mesh_set=settings_custom)  # -> report, BF_geo; plug-in component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

# ----
# create openfoam case
casefromgeos = Butterfly_CreateCaseFromGeometries(
    name=list_item,
    BF_geo=flatten([createbfgeometry_3.BF_geo, createbfgeometry_4.BF_geo, createbfgeometry_2.BF_geo, createbfgeometry_5.BF_geo, createbfgeometry.BF_geo, createbfgeometry_6.BF_geo]),
    expand_block_mesh=True,
    run=run_cfd)  # -> report, block_pts, case; plug-in component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

purgecase = Butterfly_purgeCase(case=casefromgeos.case, block_mesh=toggle_2, snappy_hex_mesh=toggle_2, results=toggle_2, post_processing=toggle_2)  # -> report; plug-in component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
panel_34 = Panel(purgecase)

blockmesh = Butterfly_blockMesh(case=casefromgeos.case, overwrite=True, write=Toggle(True), run=toggle_3)  # -> report, case; plug-in component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

snappyhexmesh = Butterfly_snappyHexMesh(
    case=blockmesh.case,
    snappy_hex_mesh_dict=snappyhexmeshdict,
    decompose_par_dict=decomposepardict_scotch,
    write=toggle_4,
    run=Toggle(True))  # -> report, case; plug-in component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

panel_35 = Panel(casefromgeos.report)
panel_36 = Panel(snappyhexmesh.report)
solution = Butterfly_Solution(
    case=snappyhexmesh.case,
    recipe=steadyincomp.recipe,
    decompose_par_dict=decomposepardict_scotch,
    solution_par=solutionparams,
    interval=2,
    write=Toggle(True),
    run=Toggle(True))  # -> report, solution, is_running, timestep, residual_fields, residual_values, log_files; plug-in component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
panel_37 = Panel(solution.report)
loadprobesvalue = Butterfly_LoadProbesValue(solution=solution.solution, field="U")  # -> values; plug-in component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
loadprobesvalue_2 = Butterfly_LoadProbesValue(solution=solution.solution, field="p")  # -> values; plug-in component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

loadmesh = Butterfly_LoadMesh(case=snappyhexmesh.case, inner_mesh=False, load=toggle_5)  # -> mesh; plug-in component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

plotresiduals = Butterfly_PlotResiduals(
    solution=solution.solution,
    rect=rec,
    target_res=0.0001,
    port=0.1,
    time_range=construct_domain_4,
    method=0,
    load=Toggle(True))  # -> report, time_range, curves, port, residual_line, colors, residuals; plug-in component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
preview_3 = CustomPreview(Geometry=plotresiduals.curves, Shader=plotresiduals.colors)
preview_4 = CustomPreview(
    Geometry=plotresiduals.residual_line,
    Shader={diffuse=RGB(255, 105, 180), emission=RGB(76, 32, 54), shine=0.5, specular=RGB(255, 255, 255), transparency=0})

# ---- group: save
save_data = Python3Script(
    mesh_list=flatten_2,
    points=flatten,
    p_values=flatten(loadprobesvalue_2),
    u_values=flatten(loadprobesvalue),
    folder="C:\Users\ellen\butterfly\extracted\",
    name=list_item,
    write=run_cfd)  # -> out; inputs mesh_list: list of Mesh, points: list of Point3d, p_values: list, u_values: list of Vector3d
# ---------- save_data: Python ----------
# -*- coding: utf-8 -*-
"""Export Points, Meshes, P (Pressure) and U (Vector3d Velocity) Values safely."""
import os
import pickle
import Rhino
import Rhino.Geometry as rg

def serialize_item(item):
    """Safely convert a single data item into a pure Python data type, handling Vector3d/Point3d."""
    if item is None:
        return None
    # Check if the item is a Rhino Vector3d or Point3d by verifying coordinates
    if hasattr(item, "X") and hasattr(item, "Y") and hasattr(item, "Z"):
        return {"__type__": "Vector3d", "data": [float(item.X), float(item.Y), float(item.Z)]}
    # Check if the item is a standard number
    elif isinstance(item, (int, float)):
        return float(item)
    else:
        return str(item)

def tree_to_dict(gh_tree):
    """Convert a Grasshopper Data Tree into a standard Python dictionary and serialize all nested objects."""
    py_dict = {}
    for i in range(gh_tree.BranchCount):
        path = gh_tree.Path(i).ToString()
        branch_data = gh_tree.Branch(i)
        py_dict[path] = [serialize_item(x) for x in branch_data]
    return py_dict

def process_value_input(val_input):
    """Process numerical or vector inputs, distinguishing between Data Trees and standard Lists."""
    if val_input is None:
        return None
    if hasattr(val_input, "BranchCount"):
        return {"type": "tree", "data": tree_to_dict(val_input)}
    else:
        return {"type": "list", "data": [serialize_item(x) for x in val_input]}

if _write and _mesh_list and _points and _folder and _name:
    if not os.path.exists(_folder):
        os.makedirs(_folder)
        
    file_path = os.path.join(_folder, _name + ".gdata")
    
    try:
        # --- 1. Process Meshes ---
        serialized_meshes = []
        for m in _mesh_list:
            if m:
                f3dm = Rhino.FileIO.File3dm()
                f3dm.Objects.AddMesh(m)
                write_options = Rhino.FileIO.File3dmWriteOptions()
                tmp_path = os.path.join(_folder, "tmp_m.3dm")
                f3dm.Write(tmp_path, write_options)
                
                with open(tmp_path, 'rb') as tmp_f:
                    m_bytes = tmp_f.read()
                serialized_meshes.append(bytes(m_bytes))
                
                if os.path.exists(tmp_path):
                    os.remove(tmp_path)
        
        # --- 2. Process Points ---
        raw_points = []
        for p in _points:
            if p is None: continue
            if hasattr(p, "X") and hasattr(p, "Y") and hasattr(p, "Z"):
                raw_points.append([float(p.X), float(p.Y), float(p.Z)])
            else:
                doc_obj = Rhino.RhinoDoc.ActiveDoc.Objects.Find(p)
                if doc_obj and doc_obj.Geometry:
                    geom = doc_obj.Geometry
                    if isinstance(geom, rg.Point):
                        raw_points.append([float(geom.Location.X), float(geom.Location.Y), float(geom.Location.Z)])

        # --- 3. Process P (Pressure) and U (Velocity Vector) Data Fields Separately ---
        saved_p_values = process_value_input(_p_values)
        saved_u_values = process_value_input(_u_values)

        # Pack everything into a unified serialization dictionary
        data_to_save = {
            "meshes": serialized_meshes,
            "points": raw_points,
            "p_values": saved_p_values,
            "u_values": saved_u_values
        }
        
        with open(file_path, 'wb') as f:
            pickle.dump(data_to_save, f, pickle.HIGHEST_PROTOCOL)
            
        print("📊 Success: [Geometry + P Pressure + U Velocity Vector] successfully packaged!\nPath: {}".format(file_path))
        
    except Exception as e:
        print("❌ Error: Packaging failed: {}".format(e))
else:
    print("⏳ Waiting for data input... Ensure geometries, P/U data are connected, and _write is set to True.")
# ---------- end save_data ----------

# ---- group: facade & table
data_dam = DataDam(DataDataA=triangulate.Mesh, BufferDelay=10000000, BufferMode=0)
opaquemod = HBOpaqueModifier(name="desk", reflect=Slider(0.5, range=0..1), rough=Slider(0.1, range=0..0.1))  # -> modifier; plug-in component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
tables = Brep([<brep referenced from the Rhino model> x36])
shade = HBShade(geo=triangulate.Mesh, rad_mod=transmod)  # -> report, shades; plug-in component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
shade_2 = HBShade(geo=tables, rad_mod=opaquemod)  # -> out, shades; plug-in component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
merge_5 = Merge(Data1=shade.shades, Data2=shade_2.shades)

# ----
data_dam_2 = DataDam(DataDataA=sporph, BufferDelay=10000000, BufferMode=0)

# ----
# Model
model = HBModel(rooms=flatten(bordershades.hb_objs), shades=flatten(merge_5), name=list_item)  # -> out, model; plug-in component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
vizwiref = HBVisualizeWireframe(hb_objs=flatten(model.model))  # -> geo; plug-in component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

# ----
# Grid
number_slider_8 = Slider(1, range=0..10)
gridrooms = HBSensorGridFromRooms(rooms=bordershades.hb_objs, grid_size="0.5", dist_floor=number_slider_8)  # -> grid, points, mesh; plug-in component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
assigngridsviews = HBAssignGridsAndViews(model=model.model, grids=flatten(gridrooms.grid))  # -> model; plug-in component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

# ---- group: grid
gridapertures = HBSensorGridFromApertures(hb_objs=bordershades.hb_objs, grid_size="0.05", offset="-0.1")  # -> grid, points, mesh; plug-in component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
assigngridsviews_2 = HBAssignGridsAndViews(model=model.model, grids=flatten(gridapertures.grid))  # -> model; plug-in component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

# ----
# Annual Daylight Analysis
toggle_6 = BooleanToggle(True)
annualdaylight = HBAnnualDaylight(model=assigngridsviews, wea=wea, north=unit_x, enhanced=toggle_6, run=run_daylight)  # -> report, results, DA, cDA, UDI, UDI_low, UDI_up; plug-in component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

# ----
# Culmulative Radiation
cumulativeradiation = HBCumulativeRadiation(model=assigngridsviews_2, wea=wea, north=unit_x, run=run_rad)  # -> out, avg_irr, radiation; plug-in component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
average_3 = Average(Input=cumulativeradiation.avg_irr)
average_4 = Average(Input=cumulativeradiation.radiation)
panel_38 = Panel(average_3)
panel_39 = Panel(average_4)

# ----
# Visualize Daylight Autonomy
number_slider_9 = Slider(1, range=0..10)
colrange = LBColorRange(index=number_slider_9)  # -> colors; plug-in component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
legendpar_2 = LBLegendParameters(
    min="10",
    max="85",
    colors=[ColourSwatch(SwatchColor=RGBA(255, 255, 255, 100)), ColourSwatch(SwatchColor=RGBA(178, 0, 0, 100))])  # -> leg_par; plug-in component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
mjoin = MeshJoin(Meshes=gridrooms.mesh)
data = Data(flatten(annualdaylight.DA))
heatmap = LBSpatialHeatmap(values=data, mesh=mjoin, legend_par=legendpar_2, legend_title="%")  # -> mesh, legend, title, colors, legend_par, vis_set; plug-in component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

mesh_join = MeshJoin(Meshes=gridapertures.mesh)
data_2 = Data(flatten(read_result.avg_irr_values))
data_3 = Data(flatten(read_result.rad_values))
heatmap_2 = LBSpatialHeatmap(values=data_3, mesh=mesh_join, legend_title="%")  # -> mesh, legend, title, colors, legend_par, vis_set; plug-in component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

# ----
# Compute sDA
sda = HBSpatialDaylightAutonomy(DA=annualdaylight.DA)  # -> report, sDA, pass_fail; plug-in component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
sda_in_each_room = Panel(sda.sDA)

# ----
# Visualize Hourly
# Illuminance for
# a Sensor
panel_40 = Panel("60")
pt_2 = Point(gridrooms.points)
data_4 = Data(annualdaylight.results)
bang = ExplodeTree(Data=pt_2)  # -> Branch0, Branch1
item = ListItem(List=bang.Branch0, Index=panel_40, Wrap=True)
sph = Sphere(Base=item, Radius="0.5")
annualtodata = HBAnnualResultsToData(results=flatten(data_4), sel_pts=flatten(item), all_pts=pt_2)  # -> out, data; plug-in component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
hourlyplot = LBHourlyPlot(data=annualtodata.data, base_pt="50,0,0", legend_par=legendpar)  # -> report, mesh, legend, borders, labels, title, vis_set; plug-in component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

# ----
# ASE
ase = HBAnnualSunlightExposure(results=flatten(data_4))  # -> out, ASE, hrs_above; plug-in component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
panel_41 = Panel(ase.ASE)
larger_than = LargerThan(FirstNumber=ase.hrs_above, SecondNumber="250")  # -> LargerThan, OrEqualTo
mesh_explode = MeshExplode(Mesh=gridrooms.mesh, Interpolate=False)
cull_pattern = CullPattern(List=mesh_explode, CullPattern=larger_than.LargerThan)
deconstruct_mesh = DeconstructMesh(Mesh=cull_pattern)  # -> Vertices, Faces, Colours, Normals
colour_swatch = ColourSwatch(SwatchColor=RGBA(11, 0, 38, 100))
construct_mesh = ConstructMesh(Vertices=deconstruct_mesh.Vertices, Faces=deconstruct_mesh.Faces)
mesh_join_2 = MeshJoin(Meshes=flatten(construct_mesh))
mesh_edges = MeshEdges(Mesh=mesh_join_2)  # -> NakedEdges, InteriorEdges, NonManifoldEdges
unit_z_6 = UnitZ(Factor=Slider(-1.5, range=-1.5..0))
curve_3 = Curve(mesh_edges.NakedEdges)
move_7 = Move(Geometry=construct_mesh, Motion=unit_z_6)  # -> Geometry, Transform
pipe = Pipe(Curve=curve_3, Radius=Slider(0.02, range=0..0.1), Caps=0, FitRail=False)
custom_preview = CustomPreview(Geometry=pipe, Material=ColourSwatch(SwatchColor=RGBA(0, 0, 0, 208)))
custom_preview_2 = CustomPreview(Geometry=move_7.Geometry, Material=ColourSwatch(SwatchColor=RGB(82, 64, 128)))

# ----
# RESULT VISUALIZATION
number_slider_10 = Slider(0, range=0..10)
number_slider_11 = Slider(1.2, range=0..10)
number_slider_12 = Slider(0, range=0..0.1)
colrange_2 = LBColorRange(index=number_slider_10)  # -> reverse(colors); plug-in component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
legendpar_3 = LBLegendParameters(
    min=number_slider_12,
    max=number_slider_11,
    colors=[ColourSwatch(SwatchColor=RGBA(255, 255, 255, 100)), ColourSwatch(SwatchColor=RGBA(178, 0, 0, 100))])  # -> leg_par; plug-in component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
mjoin_2 = MeshJoin(Meshes=tree_branch)
unit_y_4 = UnitY(Factor=Slider(2, range=0..10))
unit_z_7 = UnitZ(Factor=Slider(-2, range=-2..0))

scale = Slider(0.09, range=0..0.1)

vlen_2 = VectorLength(Vector=tree_branch_2)
bnd = Bounds(Numbers=vlen_2)
dedomain = DeconstructDomain(Domain=bnd)  # -> Start, End
gradient = Gradient(LowerLimit=dedomain.Start, UpperLimit="1.8", Parameter=vlen_2, stops=[0: RGBA(189, 0, 0, 180), 1: RGBA(0, 0, 0, 242)])
scale_2 = Slider(0.26, range=0..1)

number_3 = Number(vlen_2)
python_3_script_3 = Python3Script(vel=number_3)  # -> out, clean_val; inputs vel: list of Double
# ---------- python_3_script_3: Python ----------
clean_val = []
for i, v in enumerate(vel):
    if v > 50.0:
        clean_val.append(vel[i+2])
    else:
        clean_val.append(v)
# ---------- end python_3_script_3 ----------
heatmap_3 = LBSpatialHeatmap(values=python_3_script_3.clean_val, mesh=mjoin_2, legend_par=legendpar_3)  # -> mesh, legend, title, colors, legend_par, vis_set; plug-in component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
multiplication_4 = Multiplication(A=tree_branch_2, B=scale_2)
createlegend = LBCreateLegend(values=[number_slider_12, number_slider_11], legend_par=heatmap_3.legend_par)  # -> mesh, title_obj, label_objs, label_text, colors; plug-in component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
round_to_decimal_place = RoundToDecimalPlace(NumberX=vlen_2, DecimalPlace=Slider(1, range=0..1), RoundType=0)  # -> Rounded, Difference
text_tag_3d = TextTag3D(
    Location=tree_branch_3,
    Text=round_to_decimal_place.Rounded,
    Size=scale,
    Colour=ColourSwatch(SwatchColor=RGB(31, 31, 31)),
    Justification=7)

vdisex = VectorDisplayEx(Point=tree_branch_3, Vector=multiplication_4, Colour=gradient, Width=Slider(1.4, range=0..5))

# ----
# Gcode Generator
list_length_6 = ListLength(List=flatten(extrude))
construct_domain_7 = ConstructDomain(DomainStart=0, DomainEnd=expr("x-1", list_length_6))
sub_list_5 = SubList(List=gene_pool_4, Domain=construct_domain_7, Wrap=True)  # -> List, Index
panel_42 = Panel("demo")

# ---- group: offset length calculation
expression_3 = Expression(extrude_thickness=thickness_radius, infill_ratio=graft(sub_list_5.List), Expression="2*extrude_thickness/infill_ratio")

# ----
duplicate_data_3 = DuplicateData(Data=expression_3, Number=list_length_3, Order=True)  # -> graft(Data)

# ---- group: offset direction
xy_plane_8 = XYPlane(Origin=circle_fit_2.Circle)  # -> simplify(Plane)
rotate_plane = RotatePlane(Plane=xy_plane_8, Angle=degrees(replace_items))
deconstruct_plane_3 = DeconstructPlane(Plane=rotate_plane)  # -> Origin, XAxis, YAxis, ZAxis
reverse = Reverse(Vector=deconstruct_plane_3.XAxis)
amplitude_6 = Amplitude(Vector=[deconstruct_plane_3.XAxis, reverse], Amplitude=duplicate_data_3)

# ----
division_5 = Division(A=circle_fit_2.Radius, B=duplicate_data_3)

# ---- group: array of printing curves
# Clean, Trim, Sort, Flip Printing Paths
linear_array = LinearArray(Geometry=simplify(rotate_5.Geometry), Direction=amplitude_6, Count=division_5)  # -> Geometry, Transform

# ---- group: clean the replicated central curve
trim_tree_3 = TrimTree(Tree=linear_array.Geometry, Depth=1)  # -> simplify(Tree)
list_length_7 = ListLength(List=trim_tree_3)  # -> expr("x-1", Length)
construct_domain_8 = ConstructDomain(DomainStart="1", DomainEnd=list_length_7)
sub_list_6 = SubList(List=trim_tree_3, Domain=construct_domain_8, Wrap=True)  # -> List, Index

# ---- group: pattern in the boundary
xy_plane_9 = XYPlane(Origin=Point(0, 0, 0))
trim_with_region = TrimWithRegion(Curve=simplify(sub_list_6.List), Region=project_2.Geometry, Plane=xy_plane_9)  # -> Inside, Outside
trim_tree_4 = TrimTree(Tree=trim_with_region.Inside, Depth=1)

# ---- group: sort printing sequence
curve_middle_3 = CurveMiddle(Curve=trim_tree_4)
plane_coordinates = PlaneCoordinates(Point=curve_middle_3, System=rotate_plane)  # -> XCoordinate, YCoordinate, ZCoordinate
sort_list = SortList(Keys=plane_coordinates.XCoordinate, ValuesCurves=trim_tree_4)  # -> Keys, ValuesCurves

# ---- group: move back to the original z-axis
trim_tree_5 = TrimTree(Tree=contour, Depth=1)
list_length_8 = ListLength(List=simplify(trim_tree_5))
series = Series(Start=0, Step=layer_height_mm, Count=list_length_8)
unit_z_8 = UnitZ(Factor=series)
move_8 = Move(Geometry=simplify(sort_list.ValuesCurves), Motion=graft(unit_z_8))  # -> Geometry, Transform

# ---- group: flip the odd layer, travel path zigzag
dispatch_2 = Dispatch(List=simplify(move_8.Geometry), DispatchPattern=[True, False])  # -> ListA, ListB
flip_curve_2 = FlipCurve(Curve=dispatch_2.ListA)  # -> Curve, Flag
weave_2 = Weave(Pattern=[0, 1], Stream0=flip_curve_2.Curve, Stream1=dispatch_2.ListB, NullGaps=False)

# ---- group: weave all the printing path
insert_items = InsertItems(List=weave_2, Item=offset_curve_2, Indices="0", Wrap=True)

# ----
number_slider_13 = Slider(60, range=0..100)
bambu_x1c_printing_parameters = Python3Script(PrintSpeed=number_slider_13, FirstLayerSpeed=number_slider_13)  # -> out, Params
# ---------- bambu_x1c_printing_parameters: Python ----------
"""
Grasshopper Python Component: TPU/TPE Print Parameters (Bambu X1C + Cool Plate)
================================================================================
This component collects all printing parameters and packs them into a single
dictionary that is wired into the G-code generator component as "Params".

All inputs are optional — leave a wire disconnected to use the TPU/TPE default.

Inputs:
    NozzleTemp       : int   - Nozzle temperature °C         (default 220, range 210-230)
    BedTemp          : int   - Bed temperature °C            (default 35,  range 0-45)
                               NOTE: softening temp is 55°C; bed must stay below that.
    FanSpeed         : int   - Part cooling fan 0-255        (default 220 ≈ 86%)
                               SMP cooling is critical — fan runs from layer 1 always.
    LayerHeight      : float - Layer height mm               (default 0.2)
    LineWidth        : float - Extrusion line width mm       (default 0.45)
    PrintSpeed       : float - Normal print speed mm/s       (default 45, range 30-60)
    FirstLayerSpeed  : float - First layer speed mm/s        (default 25)
    TravelSpeed      : float - Travel (non-print) speed mm/s (default 150)
    RetractLen       : float - Retraction length mm          (default 0.8)
    RetractSpeed     : float - Retraction speed mm/s         (default 30)
    FlowRatio        : float - Extrusion flow multiplier     (default 0.98)

Output:
    Params : dict  - Parameter dictionary → wire to G-code generator
    Info   : str   - Human-readable summary of active values
"""

# ── Defaults (TPU/TPE on Bambu X1C Cool Plate) ────────────────────────────────
DEFAULTS = {
    "nozzle_temp"       : 220,    # °C
    "bed_temp"          : 35,     # °C  (Cool Plate; softening temp 55°C)
    "fan_speed"         : 220,    # 0-255  (≈86%; SMP needs 80-100%)
    "layer_height"      : 0.2,    # mm
    "line_width"        : 0.45,   # mm
    "print_speed"       : 45.0,   # mm/s
    "first_layer_speed" : 25.0,   # mm/s
    "travel_speed"      : 500.0,  # mm/s
    "retract_len"       : 0.8,    # mm
    "retract_speed"     : 30.0,   # mm/s
    "flow_ratio"        : 0.98,   # —
}

# ── Clamp rules: (min, max) ────────────────────────────────────────────────────
CLAMPS = {
    "nozzle_temp"       : (210,  230),
    "bed_temp"          : (0,    45),    # hard ceiling below softening temp
    "fan_speed"         : (0,    255),
    "layer_height"      : (0.05, 0.35),
    "line_width"        : (0.2,  0.8),
    "print_speed"       : (10.0, 100.0),
    "first_layer_speed" : (5.0,  60.0),
    "travel_speed"      : (50.0, 500.0),
    "retract_len"       : (0.0,  5.0),
    "retract_speed"     : (5.0,  60.0),
    "flow_ratio"        : (0.5,  1.5),
}

# ── Descriptions (shown in Info output) ───────────────────────────────────────
UNITS = {
    "nozzle_temp"       : "°C",
    "bed_temp"          : "°C",
    "fan_speed"         : "/255",
    "layer_height"      : "mm",
    "line_width"        : "mm",
    "print_speed"       : "mm/s",
    "first_layer_speed" : "mm/s",
    "travel_speed"      : "mm/s",
    "retract_len"       : "mm",
    "retract_speed"     : "mm/s",
    "flow_ratio"        : "",
}


def _resolve(gh_val, default):
    """Return gh_val if provided and non-empty, otherwise default."""
    if gh_val is None:
        return default
    try:
        if len(gh_val) == 0:
            return default
    except TypeError:
        pass
    return gh_val


def _clamp(key, value):
    lo, hi = CLAMPS[key]
    return max(lo, min(hi, value))


# ── Build parameter dict ───────────────────────────────────────────────────────
p = {}
p["nozzle_temp"]        = _clamp("nozzle_temp",       int(float(_resolve(NozzleTemp,      DEFAULTS["nozzle_temp"]))))
p["bed_temp"]           = _clamp("bed_temp",           int(float(_resolve(BedTemp,         DEFAULTS["bed_temp"]))))
p["fan_speed"]          = _clamp("fan_speed",          int(float(_resolve(FanSpeed,        DEFAULTS["fan_speed"]))))
p["layer_height"]       = _clamp("layer_height",       float(_resolve(LayerHeight,         DEFAULTS["layer_height"])))
p["line_width"]         = _clamp("line_width",         float(_resolve(LineWidth,           DEFAULTS["line_width"])))
p["print_speed"]        = _clamp("print_speed",        float(_resolve(PrintSpeed,          DEFAULTS["print_speed"])))
p["first_layer_speed"]  = _clamp("first_layer_speed",  float(_resolve(FirstLayerSpeed,     DEFAULTS["first_layer_speed"])))
p["travel_speed"]       = _clamp("travel_speed",       float(_resolve(TravelSpeed,         DEFAULTS["travel_speed"])))
p["retract_len"]        = _clamp("retract_len",        float(_resolve(RetractLen,          DEFAULTS["retract_len"])))
p["retract_speed"]      = _clamp("retract_speed",      float(_resolve(RetractSpeed,        DEFAULTS["retract_speed"])))
p["flow_ratio"]         = _clamp("flow_ratio",         float(_resolve(FlowRatio,           DEFAULTS["flow_ratio"])))

# ── Output ─────────────────────────────────────────────────────────────────────
Params = p

# Human-readable summary
lines = ["TPU/TPE Print Parameters (Bambu X1C + Cool Plate)",
         "=" * 50,
         "  [!] Softening temp 55°C — bed capped at 45°C, fan always ON",
         ""]
for key, val in p.items():
    label = key.replace("_", " ").title()
    unit  = UNITS[key]
    default_marker = "  [default]" if val == DEFAULTS[key] else ""
    # Extra note for fan
    if key == "fan_speed":
        pct = "{:.0f}%".format(val / 255.0 * 100)
        lines.append("  {:22s}: {} {} ({}){}".format(label, val, unit, pct, default_marker))
    else:
        lines.append("  {:22s}: {} {}{}".format(label, val, unit, default_marker))

Info = "\n".join(lines)
# ---------- end bambu_x1c_printing_parameters ----------
gcode_generator = Python3Script(Paths=insert_items, FileName=panel_21, Folder=panel_17, Save=boolean_toggle, Params=bambu_x1c_printing_parameters.Params)  # -> out, a; inputs Paths: tree of Curve, Params: list
# ---------- gcode_generator: Python ----------
"""
Grasshopper Python Component: Bambu X1C TPU/TPE G-code Generator
=================================================================
Compatible with Bambu Lab X1C + Cool Plate
Material: TPU/TPE (SMP) — softening temp 55°C, fan always ON

Inputs:
    Paths    : DataTree<Curve>  — structure {Layer ; Zone}
    Params   : dict             — from "TPU Print Parameters" component
    Folder   : str
    FileName : str
    Save     : bool

Output:
    a        : str  — status message
"""

import Rhino.Geometry as rg
import math
import os

# ─────────────────────────────────────────────────────────────
# Built-in TPU/TPE defaults
# ─────────────────────────────────────────────────────────────
_DEFAULTS = {
    "nozzle_temp"       : 220,
    "bed_temp"          : 35,
    "fan_speed"         : 220,   # 0-255  (~86%)
    "layer_height"      : 0.2,
    "line_width"        : 0.45,
    "print_speed"       : 45.0,  # mm/s
    "first_layer_speed" : 25.0,  # mm/s
    "travel_speed"      : 500.0, # mm/s — Bambu uses F30000
    "retract_len"       : 0.8,   # mm
    "retract_speed"     : 30.0,  # mm/s
    "flow_ratio"        : 0.98,
}

_FILAMENT_DIAMETER = 1.75
_FILAMENT_AREA     = math.pi * (_FILAMENT_DIAMETER / 2.0) ** 2

# Bambu authentic speed constants (mm/min)
_TRAVEL_F       = 30000   # G1 travel F value (Bambu standard)
_RETRACT_SMALL_F = 1800   # end-of-path small retract
_UNRETRACT_F    = 1800

# Bambu X1C build plate center (mm)
_BED_CENTER_X = 128.0
_BED_CENTER_Y = 128.0

# Minimum travel distance to trigger retract (mm) — Bambu default 1.0 mm
_MIN_RETRACT_TRAVEL = 1.0


def _resolve_params(gh_params):
    raw = dict(_DEFAULTS)
    if gh_params is not None:
        try:
            # GH may pass a list/tree even if we only want one dict.
            # Always just take the FIRST dict found — prevents running N times.
            if isinstance(gh_params, dict):
                raw.update(gh_params)
            elif hasattr(gh_params, '__iter__'):
                for item in gh_params:
                    if isinstance(item, dict):
                        raw.update(item)
                        break   # stop after first dict, ignore the rest
        except Exception:
            pass
    p = dict(raw)
    # Convert mm/s → mm/min
    p["print_speed_f1"]  = int(p["first_layer_speed"] * 60.0)   # Layer 1  (F3000 range)
    p["print_speed_f2"]  = int(p["print_speed"]        * 60.0)   # Layer 2+ (F3600 range)
    p["retract_speed_f"] = int(p["retract_speed"]       * 60.0)
    return p


# ─────────────────────────────────────────────────────────────
# Extrusion calculator
# ─────────────────────────────────────────────────────────────
def _calc_e(dist_mm, p):
    """Volumetric extrusion: rectangle cross-section."""
    cross = p["layer_height"] * p["line_width"]
    return (cross / _FILAMENT_AREA) * dist_mm * p["flow_ratio"]


# ─────────────────────────────────────────────────────────────
# Start G-code  (authentic Bambu X1C sequence)
# ─────────────────────────────────────────────────────────────
def _start_gcode(p):
    purge_f      = int(12.0 / (0.3 * 0.5) * 60)   # volumetric purge speed
    purge_f_slow = purge_f // 4

    return [
        "; ===== Bambu X1C TPU/TPE (SMP) Start G-code =====",
        "; Material  : TPU/TPE | Plate: Cool Plate",
        "; Nozzle    : {}C | Bed: {}C | Fan: {}/255 ({:.0f}%)".format(
            p["nozzle_temp"], p["bed_temp"], p["fan_speed"], p["fan_speed"]/255.0*100),
        "; Layer h   : {:.2f} mm | Line w: {:.2f} mm | Flow: {:.3f}".format(
            p["layer_height"], p["line_width"], p["flow_ratio"]),
        "; Print spd : {:.0f} mm/s (L1) / {:.0f} mm/s (L2+)".format(
            p["first_layer_speed"], p["print_speed"]),
        "; Retract   : {:.2f} mm @ {:.0f} mm/s".format(p["retract_len"], p["retract_speed"]),
        "; [!] Softening temp 55C -- fan ALWAYS ON from layer 1",
        "",
        "; ----- Machine init -----",
        "M73 P0 R1",
        "M201 X20000 Y20000 Z500 E5000",
        "M203 X500 Y500 Z20 E30",
        "M204 P20000 R5000 T20000",
        "M205 X9.00 Y9.00 Z3.00 E2.50",
        "M106 S0",
        "M106 P2 S0",
        "",
        "; ----- Heatbed preheat -----",
        "M140 S{}                           ; set bed temp".format(p["bed_temp"]),
        "M190 S{}                           ; wait for bed temp".format(p["bed_temp"]),
        "",
        "; ----- Machine reset & axis init -----",
        "M290 X40 Y40 Z2.6666666",
        "G91",
        "M17 Z0.4",
        "G380 S2 Z30 F300",
        "G380 S2 Z-25 F300",
        "G1 Z5 F300",
        "G90",
        "M17 X1.2 Y1.2 Z0.75",
        "M960 S5 P1                         ; logo lamp on",
        "G90",
        "M220 S100",
        "M221 S100",
        "M73.2 R1.0",
        "M1002 set_gcode_claim_speed_level : 5",
        "M221 X0 Y0 Z0",
        "G29.1 Z0",
        "M204 S10000",
        "",
        "; ----- Nozzle preheat (low to activate HB fan) -----",
        "M104 S75",
        "M106 P2 S100                       ; aux fan on for toolhead cooling",
        "",
        "; ----- Heat nozzle for TPU -----",
        "M104 S{}".format(p["nozzle_temp"]),
        "G91",
        "G0 Z10 F1200",
        "G90",
        "G28 X",
        "M975 S1                            ; vibration suppression on",
        "G1 X60 F12000",
        "G1 Y245",
        "G1 Y265 F3000",
        "M109 S{}                           ; wait nozzle temp".format(p["nozzle_temp"]),
        "",
        "; ----- Filament runout -----",
        "M412 S1",
        "",
        "; ----- Bed leveling (ABL) -----",
        "G1 X128 Y128 F24000",
        "G28 Z P0",
        "M972 S5 P0",
        "G1 X230 Y15 F24000",
        "M1002 gcode_claim_action : 1",
        "G29 A X0 Y0 I256 J256",
        "M400",
        "M500",
        "",
        "; ----- Vibration suppression -----",
        "M975 S1",
        "",
        "; ----- SMP part cooling fan ON (55C softening -- never suppress) -----",
        "M106 S{}                           ; {:.0f}% fan".format(
            p["fan_speed"], p["fan_speed"]/255.0*100),
        "",
        "; ----- Purge line -----",
        "G90",
        "M83",
        "G1 E-{:.2f} F{}".format(p["retract_len"], _UNRETRACT_F),
        "G1 X18.0 Y2.5 Z0.8 F18000",
        "G1 E{:.2f} F{}".format(p["retract_len"], _UNRETRACT_F),
        "M109 S{}".format(p["nozzle_temp"]),
        "G1 Z{:.2f}".format(p["layer_height"]),
        "G0 X239 E15 F{}".format(purge_f),
        "G0 Y12 E0.7 F{}".format(purge_f_slow),
        "G92 E0",
        "",
        "; MACHINE_START_GCODE_END",
        "G90",
        "G21",
        "M83                                ; relative extrusion",
        "M981 S1 P20000                     ; spaghetti detector on",
        "",
    ]


# ─────────────────────────────────────────────────────────────
# End G-code
# ─────────────────────────────────────────────────────────────
def _end_gcode(max_z):
    lift_z = min(max_z + 100.0, 250.0)
    return [
        "",
        "; ===== Print End =====",
        "M400",
        "G92 E0",
        "G1 E-0.8 F1800",
        "G1 Z{:.3f} F900".format(max_z + 0.5),
        "G1 X65 Y245 F12000",
        "G1 Y265 F3000",
        "G1 X65 Y245 F12000",
        "G1 Y265 F3000",
        "M140 S0                            ; bed off",
        "M106 S0                            ; part fan off",
        "M106 P2 S0",
        "M106 P3 S0",
        "M104 S0                            ; hotend off",
        "M400",
        "M17 S",
        "M17 Z0.4",
        "G1 Z{:.1f} F600".format(lift_z),
        "G1 Z{:.1f}".format(lift_z - 2.0),
        "M400 P100",
        "M17 R",
        "M220 S100",
        "M201.2 K1.0",
        "M73.2 R1.0",
        "M1002 set_gcode_claim_speed_level : 0",
        "M17 X0.8 Y0.8 Z0.5",
        "M960 S5 P0                         ; logo lamp off",
        "M73 P100 R0",
    ]


# ─────────────────────────────────────────────────────────────
# Layer change block  (authentic Bambu structure)
# ─────────────────────────────────────────────────────────────
def _layer_change_block(layer_idx, total_layers, z_current, z_hop, p):
    """
    Emitted at the START of each new layer (before first path travel).
    z_current = this layer's Z height.
    z_hop     = z_current + layer_height  (the hop height used during travel).
    """
    fan_s   = p["fan_speed"]
    # Aux fan (P2): Bambu uses ~70% of part fan for TPU
    aux_s   = min(255, int(fan_s * 0.78))

    lines = [
        "; CHANGE_LAYER",
        "; Z_HEIGHT: {:.3f}".format(z_current),
        "; LAYER_HEIGHT: {:.3f}".format(p["layer_height"]),
        # Fan state per layer
        "M106 S{}".format(fan_s),
        "M106 P2 S{}".format(aux_s),
    ]

    # Layer 2 only: open power-loss recovery + first-layer scan
    if layer_idx == 1:
        lines += [
            "; open powerlost recovery",
            "M1003 S1",
            "M976 S1 P1                         ; scan model before printing 2nd layer",
            "M400 P100",
            "G1 E{:.2f}".format(p["retract_len"]),
            "G1 E-{:.2f}".format(p["retract_len"]),
        ]

    lines += [
        "; layer num/total_layer_count: {}/{}".format(layer_idx + 1, total_layers),
        "; update layer progress",
        "M73 L{}".format(layer_idx + 1),
        "M991 S0 P{}                        ; notify layer change".format(layer_idx),
        "M204 S10000",
        # Bambu-style spiral Z lift (arc) — simplified to linear for GH output
        "G1 Z{:.3f} F30000".format(z_hop),
    ]
    return lines


# ─────────────────────────────────────────────────────────────
# Core generator
# ─────────────────────────────────────────────────────────────
def generate_gcode(layered_tree, p):
    gcode = []

    # ── DataTree structure: {geometry_id ; layer_idx} ──────────────────────────
    # Indices[0] = geometry / object ID  (zone key)
    # Indices[1] = layer index           (layer key)
    # Each branch contains N curves for that object on that layer.
    #
    # If tree is only one level deep {layer_idx}, treat Indices[0] as layer.
    # Either way we remap layer keys to sequential 0-based ints.

    raw_layers = {}   # raw_layer_key -> list of (zone_key, branch)
    for i in range(layered_tree.BranchCount):
        branch  = layered_tree.Branch(i)
        indices = layered_tree.Path(i).Indices
        if len(indices) >= 2:
            zi = int(indices[0])   # geometry / object id -> zone
            li = int(indices[1])   # layer index
        elif len(indices) == 1:
            zi = 0
            li = int(indices[0])
        else:
            zi = 0
            li = i
        raw_layers.setdefault(li, []).append((zi, branch))

    # Remap layer keys to sequential 0-based indices (sorted by original key)
    sorted_layer_keys = sorted(raw_layers.keys())
    total_layers      = len(sorted_layer_keys)
    max_z             = total_layers * p["layer_height"]
    layers            = {seq: raw_layers[k] for seq, k in enumerate(sorted_layer_keys)}

    # ── Auto-center: compute XY bounding box across ALL curves ──────────────
    # Collect every point from every curve in every branch
    all_x = []
    all_y = []
    for zone_list in layers.values():
        for _zi, branch in zone_list:
            for curve in branch:
                if curve is None:
                    continue
                bbox = curve.GetBoundingBox(True)
                if bbox.IsValid:
                    all_x.append(bbox.Min.X)
                    all_x.append(bbox.Max.X)
                    all_y.append(bbox.Min.Y)
                    all_y.append(bbox.Max.Y)

    if all_x and all_y:
        geom_cx = (min(all_x) + max(all_x)) / 2.0
        geom_cy = (min(all_y) + max(all_y)) / 2.0
        ox = _BED_CENTER_X - geom_cx   # X offset to apply to every coordinate
        oy = _BED_CENTER_Y - geom_cy   # Y offset
    else:
        ox, oy = 0.0, 0.0

    gcode += _start_gcode(p)
    gcode.append("; Auto-center offset: X{:+.3f} Y{:+.3f}".format(ox, oy))
    gcode.append("; Geometry center was ({:.3f}, {:.3f}) -> moved to bed center ({}, {})".format(
        geom_cx if all_x else 0, geom_cy if all_y else 0, _BED_CENTER_X, _BED_CENTER_Y))

    for layer_idx in sorted(layers.keys()):
        z_current = (layer_idx + 1) * p["layer_height"]   # this layer's print Z
        z_hop     = z_current + p["layer_height"]          # Z during travel moves

        # Print speed F: layer 1 slower, layer 2+ normal
        is_first  = (layer_idx == 0)
        print_f   = p["print_speed_f1"] if is_first else p["print_speed_f2"]
        # Wall accel: Bambu uses S500 for walls, S6000 for travel, S5000 outer wall
        wall_accel       = 500
        outer_wall_accel = 500 if is_first else 5000
        travel_accel     = 6000

        # ── Layer 1: no CHANGE_LAYER block, fan already set in start ──
        # ── Layer 2+: emit CHANGE_LAYER block ──
        if layer_idx > 0:
            gcode += _layer_change_block(layer_idx, total_layers, z_current, z_hop, p)

        gcode.append("; --- Layer {} / {} | Z={:.3f} mm ---".format(
            layer_idx + 1, total_layers, z_current))

        # Layer 1 init
        if is_first:
            gcode.append("M106 S0")     # PLA-style; TPU override below
            gcode.append("M106 P2 S0")
            gcode.append("M204 S6000")
            # For TPU/SMP fan must be on — override immediately
            gcode.append("M106 S{}                           ; SMP: fan on layer 1".format(p["fan_speed"]))

        # ── Zones ──
        last_end_x = None   # track previous path end to detect short travels
        last_end_y = None
        retracted  = True   # start of layer: assume retracted state

        for zone_idx, branch in sorted(layers[layer_idx], key=lambda x: x[0]):
            gcode.append("; Zone {}".format(zone_idx))

            for curve_idx, curve in enumerate(branch):
                if curve is None:
                    continue
                try:
                    crv_len = curve.GetLength()
                except Exception:
                    crv_len = 0.0
                if crv_len < 0.01:
                    continue

                # ── Discretise curve → polyline first (needed for endpoint selection) ──
                ok, polyline = curve.TryGetPolyline()
                if not ok or polyline is None:
                    rc = curve.ToPolyline(0.05, math.radians(5), 0.05, 0.0)
                    polyline = rc.ToPolyline() if rc else None

                # Use true geometric endpoints from polyline if available,
                # otherwise fall back to curve domain endpoints.
                # This fixes the issue where PointAtStart is an interior seam point.
                if polyline is not None and polyline.Count >= 2:
                    geom_start = polyline[0]
                    geom_end   = polyline[polyline.Count - 1]
                else:
                    dom        = curve.Domain
                    geom_start = curve.PointAt(dom.Min)
                    geom_end   = curve.PointAt(dom.Max)

                # ── Choose which endpoint to start from ──────────────────────
                # Pick whichever endpoint is closer to the previous path's end.
                # This eliminates mid-curve starts and minimises travel distance.
                if last_end_x is not None:
                    d_to_start = math.sqrt((geom_start.X + ox - last_end_x)**2 +
                                           (geom_start.Y + oy - last_end_y)**2)
                    d_to_end   = math.sqrt((geom_end.X   + ox - last_end_x)**2 +
                                           (geom_end.Y   + oy - last_end_y)**2)
                    flip = d_to_end < d_to_start
                else:
                    flip = False   # first curve: no preference, use as-is

                if flip and polyline is not None:
                    # Reverse the polyline point order
                    pts = list(polyline)
                    pts.reverse()
                    polyline = rg.Polyline(pts)
                    geom_start, geom_end = geom_end, geom_start

                sx = geom_start.X + ox
                sy = geom_start.Y + oy
                ex = geom_end.X   + ox
                ey = geom_end.Y   + oy

                # ── Feature label ──
                total_curves = sum(1 for c in branch if c is not None)
                if total_curves == 1:
                    feature = "Sparse infill"
                    accel   = wall_accel
                elif curve_idx == 0:
                    feature = "Inner wall"
                    accel   = wall_accel
                elif curve_idx == total_curves - 1:
                    feature = "Outer wall"
                    accel   = outer_wall_accel
                else:
                    feature = "Sparse infill"
                    accel   = wall_accel

                gcode.append("; FEATURE: {}".format(feature))
                gcode.append("; LINE_WIDTH: {:.2f}".format(p["line_width"]))

                # ── Travel to this curve's start ─────────────────────────────
                if last_end_x is not None:
                    travel_dist = math.sqrt((sx - last_end_x)**2 + (sy - last_end_y)**2)
                else:
                    travel_dist = 999.0   # first move on layer: always full travel

                if travel_dist < _MIN_RETRACT_TRAVEL:
                    # Short gap: no retract was done, just direct travel at print speed
                    # (already not retracted — state carried from previous path end)
                    gcode.append("M204 S{}".format(travel_accel))
                    gcode.append("G1 X{:.3f} Y{:.3f} F{}".format(sx, sy, _TRAVEL_F))
                else:
                    # Long travel: retract NOW (deferred from previous path end),
                    # then Z-hop, travel, drop Z, unretract
                    if not retracted:
                        gcode.append("G1 E-{:.5f} F{}".format(p["retract_len"], _RETRACT_SMALL_F))
                        retracted = True
                    gcode.append("M204 S{}".format(travel_accel))
                    gcode.append("G1 X{:.3f} Y{:.3f} Z{:.3f} F{}".format(sx, sy, z_hop, _TRAVEL_F))
                    gcode.append("G1 Z{:.3f}".format(z_current))
                    gcode.append("G1 E{:.2f} F{}".format(p["retract_len"], _UNRETRACT_F))
                    retracted = False

                # ── Print ────────────────────────────────────────────────────
                gcode.append("; {}".format(feature))
                gcode.append("G1 F{}".format(print_f))
                gcode.append("M204 S{}".format(accel))

                if polyline is None or polyline.Count < 2:
                    gcode.append("G1 X{:.3f} Y{:.3f} E{:.5f}".format(
                        ex, ey, _calc_e(crv_len, p)))
                    last_end_x, last_end_y = ex, ey
                else:
                    for j in range(1, polyline.Count):
                        pt1 = polyline[j - 1]
                        pt2 = polyline[j]
                        seg = pt1.DistanceTo(pt2)
                        if seg < 0.001:
                            continue
                        gcode.append("G1 X{:.3f} Y{:.3f} E{:.5f}".format(
                            pt2.X + ox, pt2.Y + oy, _calc_e(seg, p)))
                    last_pt = polyline[polyline.Count - 1]
                    last_end_x = last_pt.X + ox
                    last_end_y = last_pt.Y + oy

                # ── End of path: do NOT retract yet ──────────────────────────
                # Retract is deferred — only happens if the NEXT travel is long.
                # Short gap to next line = no retract, direct move, no stringing
                # (TPU is elastic so short unretraced travels are fine at this speed)
                retracted = False

    gcode += _end_gcode(max_z)
    return "\n".join(gcode)


# ─────────────────────────────────────────────────────────────
# Grasshopper entry point
# ─────────────────────────────────────────────────────────────
p = _resolve_params(Params)

if Save and Paths is not None and Folder is not None and FileName is not None:
    _folder   = str(Folder).strip()
    _filename = str(FileName).strip()
    if not _filename.lower().endswith(".gcode"):
        _filename += ".gcode"
    full_path = os.path.join(_folder, _filename)

    if not os.path.exists(_folder):
        os.makedirs(_folder)

    final_gcode = generate_gcode(Paths, p)

    with open(full_path, "w", encoding="utf-8") as f:
        f.write(final_gcode)

    a = "Saved: {}  ({} lines)".format(full_path, final_gcode.count("\n") + 1)

elif Save:
    a = "Error: Paths, Folder, or FileName input is missing."
else:
    a = "Ready -- set Save = True to generate G-code."
# ---------- end gcode_generator ----------
panel_43 = Panel(gcode_generator.a)

# ---- group: print view
pipe_2 = Pipe(Curve=insert_items, Radius=thickness_radius, Caps=0, FitRail=False)

# ---- group: Region Growing Segmentation
mesh_brep_2 = MeshBrep(
    Brep=flatten(brep_5),
    Settings={GridMaxCount=0, GridMinCount=16, JaggedSeams=False, MaxEdgeLength=0, MinEdgeLength=0.0001, MinTolerance=0, Refine=True, RefineAngle=0, RelativeTolerance=0.65, SimplePlanes=True, Tolerance=0})
mesh_join_3 = MeshJoin(Meshes=mesh_brep_2)

# ----
reduce_mesh = ReduceMesh(Mesh=mesh_join_3, FaceCount="300", Accuracy=1, FaceType=0, Distort=True, Normalize=False)  # -> Reduced, CountDifference

# ---- group: Region Growing Segmentation (continued)
region_growing_segmentation = Python3Script(M=reduce_mesh.Reduced, AngleThreshold="15")  # -> out, segments; inputs M: Mesh, AngleThreshold: Double
# ---------- region_growing_segmentation: Python ----------
import Rhino.Geometry as rg
from collections import deque
import random
import math

def region_growing_fast(mesh, angle_threshold_deg):
    mesh.FaceNormals.ComputeFaceNormals()
    num_faces = mesh.Faces.Count
    
    threshold_rad = math.radians(angle_threshold_deg)
    min_dot_product = math.cos(threshold_rad)
    
    face_labels = [-1] * num_faces
    current_region_id = 0
    
    # Pre-cache normals into a local list to avoid repetitive API boundary crossing
    # This optimization dramatically speeds up CPython loops
    normals = [mesh.FaceNormals[i] for i in range(num_faces)]
    
    for seed_idx in range(num_faces):
        if face_labels[seed_idx] != -1:
            continue
            
        # OPTIMIZATION: Use collections.deque for high-performance O(1) queue popping
        queue = deque([seed_idx])
        face_labels[seed_idx] = current_region_id
        
        while queue:
            current_face = queue.popleft() # Blazing fast compared to pop(0)
            current_normal = normals[current_face]
            
            # Query topological edge-sharing adjacent neighbors
            neighbor_faces = mesh.Faces.GetConnectedFaces(current_face, 0.0, False)
            
            for neighbor in neighbor_faces:
                if face_labels[neighbor] == -1:
                    neighbor_normal = normals[neighbor]
                    
                    # Core Vector Dot Product inline optimization
                    dot = (current_normal.X * neighbor_normal.X + 
                           current_normal.Y * neighbor_normal.Y + 
                           current_normal.Z * neighbor_normal.Z)
                    
                    if dot >= min_dot_product:
                        face_labels[neighbor] = current_region_id
                        queue.append(neighbor)
                        
        current_region_id += 1
        
    return face_labels, current_region_id

def split_mesh_by_labels(mesh, labels, num_regions):
    segmented_meshes = []
    # Pre-calculate face indices groupings to avoid nested loops over the entire mesh
    grouped_indices = [[] for _ in range(num_regions)]
    for i, label in enumerate(labels):
        if label != -1:
            grouped_indices[label].append(i)
            
    for face_indices in grouped_indices:
        if face_indices:
            temp_mesh = mesh.Duplicate()
            sub_mesh = temp_mesh.Faces.ExtractFaces(face_indices)
            if sub_mesh:
                sub_mesh.Vertices.CullUnused()
                segmented_meshes.append(sub_mesh)
                
    return segmented_meshes

# --- Grasshopper Entry ---
if 'M' in globals() and M:
    angle_tol = AngleThreshold if 'AngleThreshold' in globals() and AngleThreshold else 5.0
    labels, total_regions = region_growing_fast(M, angle_tol)
    segments = split_mesh_by_labels(M, labels, total_regions)
# ---------- end region_growing_segmentation ----------

# ----
# Surface Segmentation
number_slider_14 = Slider(1, range=0..1)
quad_remesh_settings = QuadRemeshSettings(
    TargetCount=Slider(40, range=0..1000),
    AdaptiveSize=0,
    AdaptiveCount=False,
    TargetEdgeLength=number_slider_14,
    HardEdges=False,
    SeamEdges=0,
    Symmetry=0,
    GuideCurves=0)
quad_remesh = QuadRemesh(Geometry=region_growing_segmentation.segments, Settings=quad_remesh_settings)
subd_from_mesh = SubDFromMesh(Mesh=quad_remesh, Creases=2, Corners=2, Interpolate=True)
subd_to_brep = SubDToBrep(SubD=subd_from_mesh, Packing=True, Continuity=1)
surface = Surface(simplify(graft(subd_to_brep)))  # disabled

list_item_4 = ListItem(List=region_growing_segmentation.segments, Index=Slider(0, range=0..10), Wrap=True)

# ----
# Analyze Printing Pattern Direction / Curvature
input_surface = Brep(data_dam_2)

# ---- group: build uv surface
divide_surface = DivideSurface(Surface=simplify(input_surface), UCount=Slider(4, range=0..50), VCount=Slider(7, range=0..50))  # -> Points, Normals, Parameters
trim_tree_6 = TrimTree(Tree=divide_surface.Points, Depth=1)  # -> simplify(Tree)
trim_tree_7 = TrimTree(Tree=divide_surface.Parameters, Depth=1)  # -> simplify(Tree)

# ----
trim_tree_8 = TrimTree(Tree=divide_surface.Normals, Depth=1)  # -> simplify(Tree)
principal_curvature = PrincipalCurvature(Surface=simplify(input_surface), Point=trim_tree_7)  # -> Frame, Maximum, Minimum, MaxDirection, MinDirection

# ---- group: clean principal list
null_item = NullItem(Item=principal_curvature.Maximum)  # -> NullFlags, InvalidFlags, Description
dispatch_3 = Dispatch(List=principal_curvature.Maximum, DispatchPattern=null_item.NullFlags)  # -> ListA, ListB

# ---- group: curvature
one_over_x_2 = OneOverX(Value=dispatch_3.ListB)
average_5 = Average(Input=dispatch_3.ListB)
average_6 = Average(Input=one_over_x_2)
panel_44 = Panel(average_5)
curvature_radius = Number(average_6)
curvature = Number(average_5)
panel_45 = Panel(curvature_radius)

# ---- group: find main cylinder axis
amplitude_7 = Amplitude(Vector=simplify(trim_tree_8), Amplitude=curvature_radius)
move_9 = Move(Geometry=trim_tree_6, Motion=amplitude_7)  # -> Geometry, Transform
fit_line = FitLine(Points=move_9.Geometry)

# ----
# Save Data
panel_46 = Panel("""size radius
segment count
one(0)/two(1) split
length[0]
rotate angle[0]
if edge parameter[0]
length[1]
rotate angle[1]
if edge parameter[1]
center(0) or edge(1)
thickness
infill pattern
infill ratio
curvature (if parametric
anchor location
curvature radius (if analysis
curvature (if analysis
closest specimen
printing thickness
printing infill ratio""")
entwine = Entwine(
    Branch00=size_radius_mm,
    Branch01=segment,
    Branch02=one_line_false_or_two_line_true,
    Branch03=length_mm,
    Branch04=rotate_angle,
    Branch05=if_edge_parameter,
    Branch06=length_mm_2,
    Branch07=rotate_angle_2,
    Branch08=if_edge_parameter_2,
    Branch09=center_false_or_edges_true,
    Branch010=thickness,
    Branch011=sub_list_2.List,
    Branch012=sub_list_5.List,
    Branch013=sub_list_4.List,
    Branch014=sub_list_3.List,
    Branch015=curvature_radius,
    Branch016=curvature,
    Branch017=inverse_design_lookup.closest_specimen,
    Branch018=inverse_design_lookup.estimated_thickness,
    Branch019=inverse_design_lookup.estimated_infill,
    FlattenInputs=True)
save_data_2 = Python3Script(
    sliders_data=simplify(entwine),
    surface_geom=flatten(sporph),
    paraName=panel_46,
    folder="D:\TUD\Thesis\design\typologies",
    pdataName=list_item_2,
    XMLfilename="dataset",
    write=Toggle(False))  # -> out, a; inputs sliders_data: tree, surface_geom: list of Brep, paraName: list
# ---------- save_data_2: Python ----------
# r: openpyxl
# -*- coding: utf-8 -*-
"""Centralized System: Export to pdataName.pdata AND manage central Excel (.xlsx) supporting Numbers, Tuples, and Strings seamlessly."""
import os
import pickle
import Rhino
import Rhino.Geometry as rg

try:
    import openpyxl
    from openpyxl import Workbook
except ImportError:
    raise ImportError("🚀 openpyxl is installing/loading. Please close the Python editor and click '_write' again in 5 seconds!")

def tree_to_dict(gh_tree):
    """Convert Grasshopper Data Tree to a standard Python dictionary without forcing float conversion."""
    py_dict = {}
    for i in range(gh_tree.BranchCount):
        path_str = gh_tree.Path(i).ToString()
        branch_data = list(gh_tree.Branch(i))
        # Keep raw data types so strings and numbers can both coexist safely
        py_dict[path_str] = [x for x in branch_data if x is not None]
    return py_dict

def extract_geometry_as_json(geom_item):
    """Convert any Rhino geometry into a pure Python JSON string, native to Rhino 8."""
    if geom_item is None:
        return None
    real_geo = geom_item
    if hasattr(geom_item, "Value"):
        real_geo = geom_item.Value
    elif hasattr(geom_item, "Geometry"):
        real_geo = geom_item.Geometry
    if real_geo:
        if hasattr(real_geo, "ToGeometryBase"):
            real_geo = real_geo.ToGeometryBase()
        try:
            json_options = Rhino.FileIO.SerializationOptions()
            return str(real_geo.ToJSON(json_options))
        except Exception as err:
            print("⚠️ JSON conversion failed: {}".format(err))
    return None

def clean_data_type(val):
    """Universal cleaner: keeps strings as strings, integers as int, and floats as float."""
    if val is None:
        return None
        
    # Check if the value is numeric (int or float)
    if isinstance(val, (int, float)):
        # If it has no fractional part (e.g., 55.0), strip it down to a pure integer
        if val % 1 == 0:
            return int(val)
        return float(val)
        
    # If it's already a string or any other type, let it pass natively
    return val

# --- Core Execution Logic ---
if _write and _folder and _XMLfilename and pdataName and _sliders_data:
    if not os.path.exists(_folder):
        os.makedirs(_folder)
        
    binary_file_path = os.path.join(_folder, str(pdataName) + ".pdata")
    excel_db_path = os.path.join(_folder, str(_XMLfilename) + ".xlsx")
    
    try:
        # ==========================================
        # PART 1: BINARY SERIALIZATION (.pdata for Import)
        # ==========================================
        saved_sliders = None
        if hasattr(_sliders_data, "BranchCount"):
            saved_sliders = {"type": "tree", "data": tree_to_dict(_sliders_data)}
        else:
            # Safe list comprehension handling mixed data types natively
            saved_sliders = {"type": "list", "data": [clean_data_type(x) for x in _sliders_data if x is not None]}
        
        serialized_geo_list = []
        if hasattr(_surface_geom, "__iter__") and not hasattr(_surface_geom, "BranchCount") and not hasattr(_surface_geom, "Value"):
            for item in _surface_geom:
                g_json = extract_geometry_as_json(item)
                if g_json: serialized_geo_list.append(g_json)
        else:
            g_json = extract_geometry_as_json(_surface_geom)
            if g_json: serialized_geo_list.append(g_json)

        data_to_save = {
            "sliders": saved_sliders,
            "surface_json_list": serialized_geo_list
        }
        with open(binary_file_path, 'wb') as f:
            pickle.dump(data_to_save, f, pickle.HIGHEST_PROTOCOL)
            
        # ==========================================
        # PART 2: FLIPPED EXCEL MATRIX GENERATION (.xlsx)
        # ==========================================
        wb = None
        ws = None
        
        if os.path.exists(excel_db_path):
            try:
                wb = openpyxl.load_workbook(excel_db_path)
                ws = wb.active
            except Exception as ex_err:
                print("🔄 Excel access conflict, re-initializing database: {}".format(ex_err))
                wb = None
                
        if wb is None:
            wb = Workbook()
            ws = wb.active
            ws.title = "Design Options"
            ws.cell(row=1, column=1, value="pdataName")

        # 2.1 First Pass: Clean all incoming branch data types instantly
        branch_count = _sliders_data.BranchCount if hasattr(_sliders_data, "BranchCount") else 0
        raw_branches_data = []
        for i in range(branch_count):
            vals = [clean_data_type(v) for v in list(_sliders_data.Branch(i)) if v is not None]
            raw_branches_data.append(vals)
            
        # Define condition flags safely (Check for 0 or False values in conditional branches)
        b2_is_true = True
        if len(raw_branches_data) > 2 and raw_branches_data[2]:
            if raw_branches_data[2][0] == 0 or str(raw_branches_data[2][0]).lower() == "false":
                b2_is_true = False
                
        b9_is_true = True
        if len(raw_branches_data) > 9 and raw_branches_data[9]:
            if raw_branches_data[9][0] == 0 or str(raw_branches_data[9][0]).lower() == "false":
                b9_is_true = False

        # 2.2 Second Pass: Process and format data into Excel structures
        current_data = {}
        titles_count = len(paraName) if paraName else 0
        
        for i in range(branch_count):
            title_str = paraName[i] if i < titles_count else "Branch_{}".format(i)
            current_p_name = str(title_str).strip()
            branch_values = raw_branches_data[i]
            
            # --- APPLY CONDITIONAL LOGIC ---
            if (not b2_is_true) and (i in [6, 7, 8]):
                formatted_val = "N/A"
            elif (not b9_is_true) and (i in [5, 8]):
                formatted_val = "N/A"
            else:
                # --- APPLY FORMATTING RULE: Single items as raw data, multiple items as Tuples ---
                if len(branch_values) == 1:
                    formatted_val = branch_values[0]  # Int, Float, or String enters directly
                elif len(branch_values) > 1:
                    # Multi-value formatting. If items are strings, tuple(branch_values) renders beautifully as strings
                    formatted_val = str(tuple(branch_values))  
                else:
                    formatted_val = ""  
                    
            current_data[current_p_name] = formatted_val

        # 2.3 Dynamic Column Headers Mapping (Align paraName to Columns)
        for p_name in current_data.keys():
            header_found = False
            max_col = ws.max_column
            
            for col in range(2, max_col + 1):
                if ws.cell(row=1, column=col).value == p_name:
                    header_found = True
                    break
            
            if not header_found:
                new_col_idx = max_col + 1 if max_col >= 1 else 2
                ws.cell(row=1, column=new_col_idx, value=p_name)
                print("➕ Added new parameter column header: [{}]".format(p_name))

        # 2.4 Dynamic Row Mapping (Align pdataName to Rows)
        target_row = None
        max_row = ws.max_row
        
        for r in range(2, max_row + 1):
            if ws.cell(row=r, column=1).value == str(pdataName):
                target_row = r
                break
        
        if target_row is None:
            target_row = max_row + 1 if max_row >= 1 else 2
            ws.cell(row=target_row, column=1, value=str(pdataName))
            print("➡️ Row Added: '{}'".format(pdataName))
        else:
            print("🔄 Row Refreshed: '{}'".format(pdataName))

        # 2.5 Write final values into Excel cells
        for p_name, final_value in current_data.items():
            for col in range(2, ws.max_column + 1):
                if ws.cell(row=1, column=col).value == p_name:
                    ws.cell(row=target_row, column=col, value=final_value)
                    break

        # Adjust Column widths automatically
        for col in ws.columns:
            max_len = max(len(str(cell.value or '')) for cell in col)
            col_letter = openpyxl.utils.get_column_letter(col[0].column)
            ws.column_dimensions[col_letter].width = max(max_len + 3, 14)

        wb.save(excel_db_path)

        # ==========================================
        # SUCCESS CONSOLE LOG
        # ==========================================
        print("💾 SUCCESS: Matrix synchronized with clean String/Integer/Float formatting!")
        print("📁 Saved Checkpoint: {}.pdata".format(pdataName))
        print("📊 Master Excel: {}".format(os.path.basename(excel_db_path)))
        
    except Exception as e:
        print("❌ Excel Engine Error: {}".format(e))
else:
    print("⏳ Standing by... Ensure sliders, paraName, project paths are fully configured and _write is True.")
# ---------- end save_data_2 ----------
panel_47 = Panel(save_data_2.out)

unit_x_2 = UnitX(Factor=1)
line_sdl_4 = LineSDL(Start="0,0,0", Direction=unit_x_2, Length=1)
flip_curve_3 = FlipCurve(Curve=fit_line, Guide=line_sdl_4)  # -> Curve, Flag

# ---- group: find printing pattern direction
project_3 = Project(Geometry=flip_curve_3.Curve, Plane=PlaneXY(0, 0, 0))  # -> Geometry, Transform
curve_middle_4 = CurveMiddle(Curve=flip_curve_3.Curve)
evaluate_curve_4 = EvaluateCurve(Curve=reparameterize(project_3.Geometry), Parameter="0.5")  # -> Point, Tangent, Angle
unit_x_3 = UnitX(Factor=1)
xy_plane_10 = XYPlane(Origin=curve_middle_4)
angle = Angle(VectorA=evaluate_curve_4.Tangent, VectorB=unit_x_3, Plane=xy_plane_10)  # -> Angle, Reflex
minimum = Minimum(A=angle.Angle, B=angle.Reflex)
degrees_3 = Degrees(Radians=minimum)
round_3 = Round(Number=degrees_3)  # -> Nearest, Floor, Ceiling
expression_4 = Expression(x=round_3.Nearest, Expression="if(x > 90, 180 - x, x)")
pattern_angle = Integer(expression_4)
panel_48 = Panel(pattern_angle)

# ----
# Glare
curve_4 = Curve(<curve referenced from the Rhino model>)
series_2 = Series(Start=0, Step=1, Count=Slider(24, range=0..100))
data_5 = Data(read_result.glare_hdr)
glare = HBGlarePostprocess(hdr=data_5)  # -> DGP, category, glare_indices, check_hdr; plug-in component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
panel_49 = Panel(data_5)
panel_50 = Panel([glare.DGP, glare.category])

# ----
# View
end = EndPoints(Curve=curve_4)  # -> Start, End
vec2pt = Vector2Pt(PointA=end.Start, PointB=end.End, Unitize=False)  # -> Vector, Length
vdisex_2 = VectorDisplayEx(Point=end.Start, Vector=vec2pt.Vector, Colour=RGB(0, 0, 0), Width=2)
view = HBView(name="indoor view", position=end.Start, direction=vec2pt.Vector, view_type="1")  # -> view; plug-in component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
viewport = HBViewFromViewport(name="outdoor view", refresh=Button())  # -> view; plug-in component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
assigngridsviews_3 = HBAssignGridsAndViews(model=model.model, views=flatten(view))  # -> model; plug-in component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

# ---- group: Label
hoy = LBCalculateHOY(month=number_slider, day=number_slider_2, hour=number_slider_3)  # -> flatten(hoy), flatten(doy), flatten(date); plug-in component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
toggle_7 = BooleanToggle(True)
join = TextJoin(Text=["Northeast Corner", hoy.date, glare.category])

# ----
# Glare / View Analysis
pitview = HBPointInTimeViewBased(model=assigngridsviews_3, sky=ciesky, run=run_glare)  # -> report, results; plug-in component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

falsecolor = HBFalseColor(hdr=data_5, max="2500", legend_height="650", legend_width="140", mask=Toggle(True))  # -> hdr; plug-in component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

adjusthdr = HBAdjustHDR(hdr=data_5, adj_expos=toggle_7, label=join)  # -> hdr; plug-in component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
imageviewer = LBImageViewer(ImagePath_=falsecolor, _scale_=1, DisableClickable=False, SaveImgWithCoords=False, scale=1)  # -> ImagePath, Values, GIF
lb_imageviewer = LBImageViewer(ImagePath_=adjusthdr, _scale_=1, DisableClickable=False, SaveImgWithCoords=False, scale=1)  # -> ImagePath, Values, GIF
panel_51 = Panel(lb_imageviewer.ImagePath)

# ----
# Unroll Deformed Surface
panel_52 = Panel("0.5")
cylinder_axis = Line(flip_curve_3.Curve)

# ---- group: middle section xy frame
project_4 = Project(Geometry=flip_curve_3.Curve, Plane=PlaneXY(0, 0, 0))  # -> Geometry, Transform
evaluate_curve_5 = EvaluateCurve(Curve=reparameterize(project_4.Geometry), Parameter=panel_52)  # -> Point, Tangent, Angle
unit_z_9 = UnitZ(Factor=1)
cross_product_4 = CrossProduct(VectorA=evaluate_curve_5.Tangent, VectorB=unit_z_9, Unitize=False)  # -> expr("-x", Vector), Length
vector_display_4 = VectorDisplay(Anchor=evaluate_curve_5.Point, Vector=evaluate_curve_5.Tangent)
construct_plane_3 = ConstructPlane(Origin=evaluate_curve_5.Point, XAxis=evaluate_curve_5.Tangent, YAxis=cross_product_4.Vector)

# ----
evaluate_curve_6 = EvaluateCurve(Curve=reparameterize(cylinder_axis), Parameter=panel_52)  # -> Point, Tangent, Angle
unit_z_10 = UnitZ(Factor=1)
cross_product_5 = CrossProduct(VectorA=evaluate_curve_6.Tangent, VectorB=unit_z_10, Unitize=False)  # -> expr("-x", Vector), Length
vector_display_5 = VectorDisplay(Anchor=evaluate_curve_6.Point, Vector=cross_product_5.Vector)
cross_product_6 = CrossProduct(VectorA=cross_product_5.Vector, VectorB=evaluate_curve_6.Tangent, Unitize=False)  # -> expr("-x", Vector), Length
construct_plane_4 = ConstructPlane(Origin=evaluate_curve_6.Point, XAxis=cross_product_5.Vector, YAxis=cross_product_6.Vector)
vector_display_6 = VectorDisplay(Anchor=evaluate_curve_6.Point, Vector=cross_product_6.Vector)

rolling_axis_center_frame = Plane(construct_plane_4)
curvature_radius_2 = Number(curvature_radius)

# ---- group: analysis of bounding deformed surface
bounding_box_5 = BoundingBox(Content=input_surface, Plane=construct_plane_4)  # -> Box, Box_2
deconstruct_box_3 = DeconstructBox(Box=bounding_box_5.Box)  # -> Plane, X, Y, Z
deconstruct_domain_6 = DeconstructDomain(Domain=deconstruct_box_3.Z)  # -> Start, End
subtraction_5 = Subtraction(A=deconstruct_domain_6.End, B=deconstruct_domain_6.Start)
absolute_3 = Absolute(Value=subtraction_5)

# ---- group: draw the bounding curve
circle = Circle(Plane=rolling_axis_center_frame, Radius=curvature_radius_2)

# ---- group: draw the bounding curve / domain of deformed curve on circle
deconstruct_brep_4 = DeconstructBrep(Brep=input_surface)  # -> Faces, Edges, Vertices
end_points_4 = EndPoints(Curve=deconstruct_brep_4.Edges)  # -> Start, End
curve_closest_point = CurveClosestPoint(Point=[end_points_4.Start, end_points_4.End], Curve=reparameterize(circle))  # -> Point, Parameter, Distance
bounds = Bounds(Numbers=curve_closest_point.Parameter)
deconstruct_domain_7 = DeconstructDomain(Domain=bounds)  # -> Start, End

# ----
curve_5 = Curve(deconstruct_brep_4.Edges)

# ---- group: draw the bounding curve (continued)
shatter = Shatter(Curve=reparameterize(circle), Parameters=simplify([deconstruct_domain_7.Start, deconstruct_domain_7.End]))
bounding_box_6 = BoundingBox(Content=shatter, Plane=PlaneXY(0, 0, 0))  # -> Box, Box_2
deconstruct_box_4 = DeconstructBox(Box=bounding_box_6.Box)  # -> Plane, X, Y, Z
deconstruct_domain_8 = DeconstructDomain(Domain=deconstruct_box_4.Z)  # -> Start, End
sort_list_2 = SortList(Keys=deconstruct_domain_8.End, ValuesSegment=shatter)  # -> Keys, ValuesSegment
list_item_5 = ListItem(List=sort_list_2.ValuesSegment, Index=0, Wrap=True)

# ---- group: extrude rolling ref surface / move to bottom
amplitude_8 = Amplitude(Vector=expr("-x", rolling_axis_center_frame), Amplitude=expr("x/2", simplify(absolute_3)))
move_10 = Move(Geometry=list_item_5, Motion=amplitude_8)  # -> Geometry, Transform

# ---- group: extrude rolling ref surface
amplitude_9 = Amplitude(Vector=rolling_axis_center_frame, Amplitude=simplify(absolute_3))
extrude_3 = Extrude(Base=move_10.Geometry, Direction=amplitude_9)  # -> simplify(Extrusion)

# ----
length = Length(Curve=list_item_5)

# ---- group: move to bottom left corner
deconstruct_plane_4 = DeconstructPlane(Plane=construct_plane_3)  # -> Origin, XAxis, YAxis, ZAxis
curve_closest_point_2 = CurveClosestPoint(Point=construct_plane_3, Curve=reparameterize(simplify(list_item_5)))  # -> Point, Parameter, Distance
multiplication_5 = Multiplication(A=curve_closest_point_2.Parameter, B=length)  # -> simplify(Result)
amplitude_10 = Amplitude(Vector=simplify(deconstruct_plane_4.XAxis), Amplitude=expr("-x/2", simplify(absolute_3)))
amplitude_11 = Amplitude(Vector=expr("-x", deconstruct_plane_4.YAxis), Amplitude=simplify(multiplication_5))
addition_5 = Addition(A=amplitude_10, B=amplitude_11)
move_11 = Move(Geometry=construct_plane_3, Motion=addition_5)  # -> Geometry, Transform

# ----
rectangle_3 = Rectangle(Plane=move_11.Geometry, XSize=absolute_3, YSize=length, Radius=0)  # -> Rectangle, Length

# ---- group: unroll surface
boundary_surfaces_4 = BoundarySurfaces(Edges=rectangle_3.Rectangle)  # -> simplify(Surfaces)
unro = Sporph(
    Geometry=simplify(input_surface),
    Base=reparameterize(simplify(extrude_3)),
    Target=reparameterize(simplify(boundary_surfaces_4)),
    Rigid=False)

# ---- group: extrude thickness
list_length_9 = ListLength(List=flatten(unro))
construct_domain_9 = ConstructDomain(DomainStart=0, DomainEnd=expr("x-1", list_length_9))
sub_list_7 = SubList(List=gene_pool_5, Domain=construct_domain_9, Wrap=True)  # -> List, Index
unit_z_11 = UnitZ(Factor=sub_list_7.List)  # -> simplify(graft(UnitVector))
extrude_4 = Extrude(Base=unro, Direction=unit_z_11)

# ----
geometry_to_print = Brep(extrude_4)
